# Grasshopper definition 00_basic behaviour_00.gh (Grasshopper 0.9.76)
# Copyright: Co-de-iT
# plug-ins: Anemone, Boid, Noise 4D

# ---- group: color mesh
pt = ConstructPoint(XCoordinate="0", YCoordinate="0", ZCoordinate="0")
number_slider = Slider(50, range=0..100)
rectangle = Rectangle(Plane=pt, XSize=number_slider, YSize=number_slider, Radius=0)  # -> Rectangle, Length
number_slider_2 = Slider(40, range=0..100)
mplane = MeshPlane(Boundary=rectangle.Rectangle, WidthCount=number_slider_2, HeightCount=number_slider_2)  # -> Mesh, Area
number_slider_3 = Slider(0.105, range=0..0.201)  # disabled
demesh = DeconstructMesh(Mesh=mplane.Mesh)  # -> Vertices, Faces, Colours, Normals; disabled
perlin = PerlinNoise(Values=demesh.Vertices, Time=0, Scale=number_slider_3)  # disabled
panel = Panel("-1")  # disabled
gradient = Gradient(LowerLimit=panel, UpperLimit=1, Parameter=perlin, stops=[0: RGB(255, 255, 255), 1: RGB(0, 0, 0)])  # disabled
conmesh = ConstructMesh(Vertices=demesh.Vertices, Faces=demesh.Faces, Colours=gradient)  # disabled

# ----
number_slider_4 = Slider(100, range=0..100)  # disabled
pt_2 = Point(Point(24.92672781, 10.84129804, 0))  # disabled
number_slider_5 = Slider(1, range=0..1)  # disabled
loop_start = LoopStart(Repeat=number_slider_4, Data_0=pt_2)  # -> port, Counter, Data_0; disabled
Z = UnitZ(Factor=number_slider_5)  # disabled
move = Move(Geometry=loop_start.Data_0, Motion=Z)  # -> Geometry, Transform; disabled
loop_end = LoopEnd(port=loop_start.port, Exit=False, Data_0=move.Geometry, pausedState=False, state="Constant output")  # disabled

button = Button()  # disabled

# ----
# WANDER + SEEK
number_slider_6 = Slider(20, range=0..20)  # disabled
Y = UnitY(Factor=number_slider_6)  # disabled
number_slider_7 = Slider(4, range=0..10)  # disabled
arrive = Point(Point(178.9549649, -11.43568566, 0))  # disabled
swatch = ColourSwatch(SwatchColor=RGBA(52, 113, 173, 144))  # disabled
dots = DotDisplay(Point=arrive, Colour=swatch, Size=number_slider_7)  # disabled
number_slider_8 = Slider(50, range=0..200)  # disabled
button_2 = Button()  # disabled
number_slider_9 = Slider(2, range=0..10)  # disabled
maxforce = Slider(0.105, range=0..1)  # disabled
max_vel = Slider(2.349, range=0..10)  # disabled

# ----
# STEER
number_slider_10 = Slider(20, range=0..20)  # disabled
Y_2 = UnitY(Factor=number_slider_10)  # disabled
arrive_2 = Point(Point(178.9549649, -11.43568566, 0))  # disabled
number_slider_11 = Slider(35, range=0..110)  # disabled
number_slider_12 = Slider(2, range=0..10)  # disabled
number_slider_13 = Slider(3.9, range=0..10)  # disabled
maxforce_2 = Slider(0.139, range=0..1)  # disabled

mesh = Mesh(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)  # disabled
number_slider_14 = Slider(40, range=0..100)  # disabled
popgeo = PopulateGeometry(Geometry=mesh, Count=number_slider_14, Seed=1)  # disabled
pt_3 = Point(popgeo)  # disabled
lng = ListLength(List=pt_3)  # disabled
futloc = Slider(2, range=0..10)  # disabled
demesh_2 = DeconstructMesh(Mesh=mesh)  # -> Vertices, Faces, Colours, Normals; disabled
panel_2 = Panel("2")  # disabled
swatch_2 = ColourSwatch(SwatchColor=RGB(0, 34, 255))  # disabled

rndvec = RandomVector(Number=lng, Unit=True, RandomSeed=2, AbsoluteMultiplier=1)  # disabled
devec = DeconstructVector(Vector=rndvec)  # -> XComponent, YComponent, ZComponent; disabled
vec = VectorXYZ(XComponent=devec.XComponent, YComponent=devec.YComponent, ZComponent=devec.ZComponent)  # -> unitize(simplify(Vector)), Length; disabled
merge = Merge(Data1=simplify(graft(pt_3)), Data2=simplify(graft(vec.Vector)), Data3=simplify(graft(pt_3)))  # disabled
group = Group(Objects=merge)  # -> flatten(Group); disabled

agents = Point([Point(27.66381252, -10.25946277, 0), Point(25.89416457, -24.94754074, 0), Point(17.39985441, -15.21447702, 0), Point(19.16950236, -19.81556169, 0), Point(24.8323758, -12.91393469, 0), Point(31.55703801, -16.45323059, 0), Point(36.33508747, -23.70878718, 0), Point(24.12451662, -28.48683664, 0)])  # disabled

lng_2 = ListLength(List=agents)  # disabled
repeat = RepeatData(Data=Y, Length=lng_2)  # disabled

vec_2 = Vector(repeat)  # disabled

agents_2 = Point([Point(27.66381252, -10.25946277, 0), Point(25.89416457, -24.94754074, 0), Point(17.39985441, -15.21447702, 0), Point(19.16950236, -19.81556169, 0), Point(24.8323758, -12.91393469, 0), Point(31.55703801, -16.45323059, 0), Point(36.33508747, -23.70878718, 0), Point(24.12451662, -28.48683664, 0)])  # disabled

lng_3 = ListLength(List=agents_2)  # disabled
repeat_2 = RepeatData(Data=Y_2, Length=lng_3)  # disabled

vec_3 = Vector(repeat_2)  # disabled

merge_2 = Merge(Data1=simplify(graft(agents)), Data2=simplify(graft(vec_2)))  # disabled
group_2 = Group(Objects=merge_2)  # disabled
loop_start_2 = LoopStart(Repeat=number_slider_8, Trigger=button_2, Data=group_2)  # -> port, Counter, simplify(Data); disabled
ungroup = Ungroup(Group=loop_start_2.Data)  # disabled
item = ListItem(List=ungroup, Index=0, Wrap=True)  # -> Item, Item1; disabled
amp = Amplitude(Vector=item.Item1, Amplitude=number_slider_9)  # disabled
move_2 = Move(Geometry=item.Item, Motion=amp)  # -> Geometry, Transform; disabled
cp = ClosestPoint(Point=move_2.Geometry, Cloud=arrive)  # -> ClosestPoint, CPIndex, Distance; disabled
vec2pt = Vector2Pt(PointA=move_2.Geometry, PointB=cp.ClosestPoint, Unitize=False)  # -> simplify(Vector), Length; disabled
move_3 = Move(Geometry=item.Item, Motion=item.Item1)  # -> Geometry, Transform; disabled
pt_4 = Point(item.Item)  # disabled

# ---- group: WANDER
wandering_angle = Slider(62.935, range=0..90)  # disabled
wandering_strength = Slider(0.789, range=0..1)  # disabled
rad = Radians(Degrees=wandering_angle)  # disabled
neg = Negative(Value=rad)  # disabled
lng_4 = ListLength(List=flatten(item.Item))  # disabled
dom = ConstructDomain(DomainStart=neg, DomainEnd=rad)  # disabled
random = Random(Range=dom, Number=lng_4, Seed=loop_start_2.Counter)  # -> graft(Random); disabled
Z_2 = UnitZ(Factor=1)  # disabled
vrot = Rotate(Vector=item.Item1, Axis=Z_2, Angle=random)  # disabled
addition = Addition(A=amp, B=vrot)  # disabled
steer = Steer(vel=item.Item1, des=addition, maxv=max_vel, maxf=wandering_strength)  # disabled

# ----
# steer
steer_2 = Steer(vel=item.Item1, des=vec2pt.Vector, maxv=max_vel, maxf=maxforce)  # disabled

addition_2 = Addition(A=item.Item1, B=steer_2, C=steer)  # disabled
trmvec = TrimVector(Vector=addition_2, LengthDomain=max_vel)  # disabled
move_4 = Move(Geometry=item.Item, Motion=trmvec)  # -> Geometry, Transform; disabled
merge_3 = Merge(Data1=move_4.Geometry, Data2=trmvec)  # disabled
group_3 = Group(Objects=merge_3)  # disabled
loop_end_2 = LoopEnd(port=loop_start_2.port, Exit=False, Data=group_3, pausedState=False, state="Constant & Record", TimeOutVal=0)  # disabled
ungroup_2 = Ungroup(Group=loop_end_2)  # disabled
item_2 = ListItem(List=ungroup_2, Index=0, Wrap=True)  # disabled

# ---- group: WANDER
swatch_3 = ColourSwatch(SwatchColor=RGB(168, 0, 146))  # disabled
vdisex = VectorDisplayEx(Point=pt_4, Vector=steer, Colour=swatch_3, Width=2)  # disabled

# ---- group: VELOCITY
swatch_4 = ColourSwatch(SwatchColor=RGB(0, 109, 168))  # disabled
vdisex_2 = VectorDisplayEx(Point=pt_4, Vector=item.Item1, Colour=swatch_4, Width=2)  # disabled

# ---- group: FINAL VECTOR
swatch_5 = ColourSwatch(SwatchColor=RGB(255, 255, 255))  # disabled
vdisex_3 = VectorDisplayEx(Point=pt_4, Vector=trmvec, Colour=swatch_5, Width=2)  # disabled

# ---- group: SEEK
vdisex_4 = VectorDisplayEx(Point=move_3.Geometry, Vector=steer_2, Colour=RGB(0, 0, 0), Width=2)  # disabled

# ----
merge_4 = Merge(Data1=simplify(graft(agents_2)), Data2=simplify(graft(vec_3)))  # disabled
group_4 = Group(Objects=merge_4)  # disabled
loop_start_3 = LoopStart(Repeat=number_slider_11, Trigger=button, Data=group_4)  # -> port, Counter, simplify(Data); disabled
ungroup_3 = Ungroup(Group=loop_start_3.Data)  # disabled
item_3 = ListItem(List=ungroup_3, Index=0, Wrap=True)  # -> Item, Item1; disabled
amp_2 = Amplitude(Vector=item_3.Item1, Amplitude=number_slider_12)  # disabled
move_5 = Move(Geometry=item_3.Item, Motion=amp_2)  # -> Geometry, Transform; disabled
cp_2 = ClosestPoint(Point=move_5.Geometry, Cloud=arrive_2)  # -> ClosestPoint, CPIndex, Distance; disabled
vec2pt_2 = Vector2Pt(PointA=move_5.Geometry, PointB=cp_2.ClosestPoint, Unitize=False)  # -> simplify(Vector), Length; disabled
move_6 = Move(Geometry=item_3.Item, Motion=item_3.Item1)  # -> Geometry, Transform; disabled
pt_5 = Point(item_3.Item)  # disabled

# ----
# steer
steer_3 = Steer(vel=item_3.Item1, des=vec2pt_2.Vector, maxv=number_slider_13, maxf=maxforce_2)  # disabled

addition_3 = Addition(A=item_3.Item1, B=steer_3)  # disabled
trmvec_2 = TrimVector(Vector=addition_3, LengthDomain=number_slider_13)  # disabled
move_7 = Move(Geometry=item_3.Item, Motion=trmvec_2)  # -> Geometry, Transform; disabled
merge_5 = Merge(Data1=move_7.Geometry, Data2=trmvec_2)  # disabled
group_5 = Group(Objects=merge_5)  # disabled
loop_end_3 = LoopEnd(port=loop_start_3.port, Exit=False, Data=group_5, pausedState=False, state="Constant & Record", TimeOutVal=0)  # disabled
ungroup_4 = Ungroup(Group=loop_end_3)  # disabled
item_4 = ListItem(List=ungroup_4, Index=0, Wrap=True)  # disabled

# ---- group: VELOCITY
swatch_6 = ColourSwatch(SwatchColor=RGB(0, 109, 168))  # disabled
vdisex_5 = VectorDisplayEx(Point=pt_5, Vector=item_3.Item1, Colour=swatch_6, Width=2)  # disabled

# ---- group: FINAL VECTOR
swatch_7 = ColourSwatch(SwatchColor=RGB(255, 255, 255))  # disabled
vdisex_6 = VectorDisplayEx(Point=pt_5, Vector=trmvec_2, Colour=swatch_7, Width=2)  # disabled

# ---- group: STEER
vdisex_7 = VectorDisplayEx(Point=move_6.Geometry, Vector=steer_3, Colour=RGB(0, 0, 0), Width=2)  # disabled

# ----
button_3 = Button()  # disabled
number_slider_15 = Slider(44, range=0..500)  # disabled
maxforce_3 = Slider(0.9, range=0..10)  # disabled
maxspeed = Slider(0.5, range=0..10)  # disabled
exit = Button()  # disabled

loop_start_4 = LoopStart(Repeat=number_slider_15, Trigger=button_3, Data=group)  # -> port, Counter, Data; disabled

panel_3 = Panel(loop_start_4.Counter)  # disabled

number_slider_16 = Slider(2, range=0..10)  # disabled
ungroup_5 = Ungroup(Group=loop_start_4.Data)  # -> simplify(Objects); disabled
split = SplitList(List=ungroup_5, Index=number_slider_16)  # -> simplify(ListA), simplify(ListB); disabled
item_5 = ListItem(List=split.ListA, Index=0, Wrap=True)  # -> Item, Item1; disabled

# ----
# future location
amp_3 = Amplitude(Vector=item_5.Item1, Amplitude=futloc)  # disabled
move_8 = Move(Geometry=item_5.Item, Motion=amp_3)  # -> Geometry, Transform; disabled
samples = Slider(5, range=3..10)  # disabled
# read environment
cps = ClosestPoints(Point=move_8.Geometry, Cloud=demesh_2.Vertices, Count=samples)  # -> ClosestPoint, CPIndex, Distance; disabled
item_6 = ListItem(List=demesh_2.Colours, Index=cps.CPIndex, Wrap=True)  # disabled
ahsv = SplitAHSV(Colour=item_6)  # -> Alpha, Hue, Saturation, Value; disabled

argb = SplitARGB(Colour=item_6)  # -> Alpha, Red, Green, Blue; disabled

sort = SortList(Keys=argb.Red, ValuesA=cps.ClosestPoint, ValuesB=cps.CPIndex)  # -> Keys, ValuesA, ValuesB; disabled
item_7 = ListItem(List=simplify(sort.ValuesA), Index=0, Wrap=True)  # -> Item1, Item; disabled
vec2pt_3 = Vector2Pt(PointA=item_5.Item, PointB=item_7.Item1, Unitize=False)  # -> Vector, Length; disabled

steer_4 = Steer(vel=item_5.Item1, des=vec2pt_3.Vector, maxv=maxspeed, maxf=maxforce_3)  # disabled

addition_4 = Addition(A=item_5.Item1, B=steer_4)  # disabled
trmvec_3 = TrimVector(Vector=addition_4, LengthDomain=maxspeed)  # disabled

move_9 = Move(Geometry=item_5.Item, Motion=trmvec_3)  # -> Geometry, Transform; disabled
meshcp = MeshClosestPoint(Point=move_9.Geometry, Mesh=mesh)  # -> simplify(Point), Index, Parameter; disabled

merge_6 = Merge(Data1=simplify(split.ListB), Data2=simplify(meshcp.Point))  # disabled
merge_7 = Merge(Data1=simplify(move_9.Geometry), Data2=simplify(trmvec_3), Data3=simplify(merge_6))  # disabled
group_6 = Group(Objects=merge_7)  # -> flatten(Group); disabled

loop_end_4 = LoopEnd(port=loop_start_4.port, Exit=exit, Data=group_6, pausedState=False, state="Constant output", TimeOutVal=0)  # disabled
ungroup_6 = Ungroup(Group=loop_end_4)  # disabled
split_2 = SplitList(List=ungroup_6, Index=panel_2)  # -> ListA, ListB; disabled
pt_6 = Point(split_2.ListB)  # disabled
pline = PolyLine(Vertices=pt_6, Closed=False)  # disabled
preview = CustomPreview(Geometry=pline, Shader=swatch_2)  # disabled

# ----
# CURVE BOUNDARY
number_slider_17 = Slider(4, range=0..20)  # disabled
number_slider_18 = Slider(5, range=0..20)  # disabled
Y_3 = UnitY(Factor=number_slider_17)  # disabled
number_slider_19 = Slider(4.9, range=0..6)  # disabled
arrive_3 = Point([Point(112.0093927, -3.844683141, 0), Point(1.762594617, 65.21107482, 0), Point(-45.43692704, -47.87142569, 0)])  # disabled
swatch_8 = ColourSwatch(SwatchColor=RGB(255, 255, 255))  # disabled
crv = Curve(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)
swatch_9 = ColourSwatch(SwatchColor=RGB(102, 102, 102))  # disabled
dash = DashPattern(Curve=crv, Pattern=number_slider_19)  # -> Dashes, Gaps; disabled
dots_2 = DotDisplay(Point=arrive_3, Colour=swatch_8, Size=1)  # disabled
preview_2 = CustomPreview(Geometry=dash.Dashes, Shader=swatch_9)  # disabled
border_threshold = Slider(10, range=0..10)  # disabled
number_slider_20 = Slider(350, range=0..350)  # disabled
number_slider_21 = Slider(12, range=0..1000)  # disabled
button_4 = Button()  # disabled

agents_3 = Point([Point(27.66381252, -10.25946277, 0), Point(25.89416457, -24.94754074, 0), Point(17.39985441, -15.21447702, 0), Point(19.16950236, -19.81556169, 0), Point(24.8323758, -12.91393469, 0), Point(31.55703801, -16.45323059, 0), Point(36.33508747, -23.70878718, 0), Point(24.12451662, -28.48683664, 0)])  # disabled

dup = DuplicateData(Data=graft(agents_3), Number=number_slider_18, Order=True)  # -> flatten(Data); disabled
lng_5 = ListLength(List=dup)  # disabled

repeat_3 = RepeatData(Data=Y_3, Length=lng_5)  # disabled
vec_4 = Vector(repeat_3)  # disabled

merge_8 = Merge(Data1=simplify(graft(dup)), Data2=simplify(graft(vec_4)))  # disabled
group_7 = Group(Objects=merge_8)  # disabled
loop_start_5 = LoopStart(Repeat=number_slider_20, Trigger=button_4, Data=group_7)  # -> port, Counter, Data; disabled
ungroup_7 = Ungroup(Group=loop_start_5.Data)  # disabled
item_8 = ListItem(List=ungroup_7, Index=0, Wrap=True)  # -> Item, Item1; disabled
move_10 = Move(Geometry=item_8.Item, Motion=item_8.Item1)  # -> Geometry, Transform; disabled
pt_7 = Point(item_8.Item)  # disabled

# ---- group: BORDER CONDITION
crv_cp = CurveClosestPoint(Point=item_8.Item, Curve=crv)  # -> Point, Parameter, Distance; disabled
smaller = SmallerThan(FirstNumber=crv_cp.Distance, SecondNumber=border_threshold)  # -> SmallerThan, OrEqualTo; disabled
eval = EvaluateCurve(Curve=crv, Parameter=crv_cp.Parameter)  # -> Point, Tangent, Angle; disabled
vec2pt_4 = Vector2Pt(PointA=eval.Point, PointB=item_8.Item, Unitize=False)  # -> Vector, Length; disabled
dispatch = Dispatch(List=vec2pt_4.Vector, DispatchPattern=smaller.OrEqualTo)  # -> ListA, ListB; disabled
vlen = VectorLength(Vector=dispatch.ListA)  # disabled
easing = Slider(0.63, range=0..1)  # disabled
subtraction = Subtraction(A=border_threshold, B=vlen)  # disabled
multiplication = Multiplication(A=subtraction, B=easing)  # disabled
amp_4 = Amplitude(Vector=dispatch.ListA, Amplitude=multiplication)  # disabled
pt_8 = Point(Point(0, 0, 0))  # disabled
weave = Weave(Pattern=smaller.OrEqualTo, Stream0=pt_8, Stream1=amp_4, NullGaps=False)  # disabled

# ----
number_slider_22 = Slider(2, range=0..10)  # disabled
amp_5 = Amplitude(Vector=item_8.Item1, Amplitude=number_slider_22)  # disabled
move_11 = Move(Geometry=item_8.Item, Motion=amp_5)  # -> Geometry, Transform; disabled
cp_3 = ClosestPoint(Point=move_11.Geometry, Cloud=arrive_3)  # -> ClosestPoint, CPIndex, Distance; disabled
vec2pt_5 = Vector2Pt(PointA=move_11.Geometry, PointB=cp_3.ClosestPoint, Unitize=False)  # -> simplify(Vector), Length; disabled
maxforce_4 = Slider(0.24, range=0..1)  # disabled
max_vel_2 = Slider(1.5, range=0..10)  # disabled

# ---- group: WANDER
wandering_angle_2 = Slider(62.935, range=0..90)  # disabled
wandering_strength_2 = Slider(0.789, range=0..1)  # disabled
rad_2 = Radians(Degrees=wandering_angle_2)  # disabled
lng_6 = ListLength(List=flatten(item_8.Item))  # disabled
neg_2 = Negative(Value=rad_2)  # disabled
dom_2 = ConstructDomain(DomainStart=neg_2, DomainEnd=rad_2)  # disabled
Z_3 = UnitZ(Factor=1)  # disabled
random_2 = Random(Range=dom_2, Number=lng_6, Seed=loop_start_5.Counter)  # -> graft(Random); disabled
vrot_2 = Rotate(Vector=item_8.Item1, Axis=Z_3, Angle=random_2)  # disabled
addition_5 = Addition(A=amp_5, B=vrot_2)  # disabled
steer_5 = Steer(vel=item_8.Item1, des=addition_5, maxv=max_vel_2, maxf=wandering_strength_2)  # disabled

# ----
# steer
steer_6 = Steer(vel=item_8.Item1, des=vec2pt_5.Vector, maxv=max_vel_2, maxf=maxforce_4)  # disabled

addition_6 = Addition(A=item_8.Item1, C=steer_5, D=weave)  # disabled
trmvec_4 = TrimVector(Vector=addition_6, LengthDomain=max_vel_2)  # disabled
move_12 = Move(Geometry=item_8.Item, Motion=trmvec_4)  # -> Geometry, Transform; disabled
merge_9 = Merge(Data1=simplify(move_12.Geometry), Data2=simplify(trmvec_4))  # disabled
group_8 = Group(Objects=merge_9)  # disabled
loop_end_5 = LoopEnd(port=loop_start_5.port, Exit=False, Data=simplify(group_8), pausedState=False, state="Constant & Record", TimeOutVal=0)  # disabled
ungroup_8 = Ungroup(Group=loop_end_5)  # disabled
item_9 = ListItem(List=ungroup_8, Index=0, Wrap=True)  # disabled

# ---- group: WANDER
swatch_10 = ColourSwatch(SwatchColor=RGB(168, 0, 146))  # disabled
vdisex_8 = VectorDisplayEx(Point=pt_7, Vector=steer_5, Colour=swatch_10, Width=2)  # disabled

# ---- group: VELOCITY
swatch_11 = ColourSwatch(SwatchColor=RGB(0, 109, 168))  # disabled
vdisex_9 = VectorDisplayEx(Point=pt_7, Vector=item_8.Item1, Colour=swatch_11, Width=2)  # disabled

# ---- group: FINAL VECTOR
swatch_12 = ColourSwatch(SwatchColor=RGB(255, 255, 255))  # disabled
vdisex_10 = VectorDisplayEx(Point=pt_7, Vector=trmvec_4, Colour=swatch_12, Width=2)  # disabled

# ---- group: SEEK
vdisex_11 = VectorDisplayEx(Point=move_10.Geometry, Vector=steer_6, Colour=RGB(0, 0, 0), Width=2)  # disabled

# ---- group: BOUNDARY
vdisex_12 = VectorDisplayEx(Point=eval.Point, Vector=amp_4, Colour=RGB(0, 0, 0), Width=2)  # disabled

# ==== cluster Steer
maxf = ClusterInput()
vel = ClusterInput()
maxv = ClusterInput()
des = ClusterInput()
amp = Amplitude(Vector=des, Amplitude=maxv)
subtraction = Subtraction(A=amp, B=vel)
multiplication = Multiplication(A=subtraction, B=maxf)
vlen = VectorLength(Vector=multiplication)
min = Minimum(A=vlen, B=maxv)
amp_2 = Amplitude(Vector=multiplication, Amplitude=min)
acc = ClusterOutput(amp_2)
