# Grasshopper definition 01_AugmentedBodies_00.gh (Grasshopper 0.9.76)
# Copyright: Co-de-iT
# plug-ins: MeshEdit Components, Anemone, Boid, Weaverbird

pt = Point([Point(198.7993727, 14.14454325, 1455.91779), Point(55.10412171, 14.14454325, 1455.917947), Point(123.3449972, 88.10113575, 1412.69581), Point(121.6605347, 115.0974442, 1468.274232), Point(121.8597722, 89.03436525, 1347.99943), Point(118.2321482, 108.0601657, 1297.240992)])

# ---- group: CUT MESH
srf = Surface(<surface referenced from the Rhino model>)
mesh = Mesh(<mesh referenced from the Rhino model>)
pln = Plane(srf)
msplit = MeshSplitPlane(Mesh=mesh, Plane=pln)  # -> Above, Below

# ---- group: cut mesh
mesh_2 = Mesh(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)

# ---- group: mesh originale
mesh_3 = Mesh([<mesh referenced from the Rhino model> x2])

# ---- group: VERTICAL POINT ALIGNMENT
area = MeshArea(Mesh=mesh_2)  # -> Area, Centroid
yz = YZPlane(Origin=area.Centroid)
split = SplitList(List=pt, Index=Slider(2, range=0..10))  # -> ListA, ListB
project = Project(Geometry=split.ListB, Plane=yz)  # -> Geometry, Transform
merge = Merge(Data2=project.Geometry)

# ----
mjoin = MeshJoin(Meshes=mesh_2)
number_slider = Slider(0.2, range=0..1)
Z = UnitZ(Factor=number_slider)
Y = UnitY(Factor=number_slider)
color_intensity = Slider(0.35, range=0..1)
t_rec = TailRecorder()  # -> out, simplify(Lo); inputs L: list, len: Int32
# ---------- t_rec: C# ----------
    String eol = Environment.NewLine;
    Component.Name = "Tail Recorder";
    Component.NickName = "T-Rec";
    Component.Description = "Tail recorder" + eol + "L - list of tail points" + eol + "it - item to add" + eol + "len - tail max length";

    if (L.Count() > len) {
      L.RemoveAt(0);
    }
    L.Add(it);
    Lo = L;
# ---------- end t_rec ----------

avr = Average(Input=split.ListA)
Y_2 = UnitY(Factor=Slider(100, range=0..100))
item = ListItem(List=split.ListA, Index=0, Wrap=True)  # -> Item, Item1
move = Move(Geometry=avr, Motion=Y_2)  # -> Geometry, Transform
arc = Arc3Pt(PointA=item.Item, PointB=move.Geometry, PointC=item.Item1)  # -> Arc, Plane, Radius
crv = Curve(arc.Arc)
series = Series(Start=0, Step=1, Count=Slider(4, range=0..10))
bnd = Bounds(Numbers=series)
dom = ConstructDomain(DomainStart=0, DomainEnd=1)
remap = RemapNumbers(Value=series, Source=bnd, Target=dom)  # -> Mapped, Clipped

neg = Negative(Value=Slider(34, range=0..100))

vec = VectorXYZ(XComponent=0, YComponent=Slider(1, range=0..100), ZComponent=neg)  # -> Vector, Length
move_2 = Move(Geometry=crv, Motion=vec.Vector)  # -> Geometry, Transform

curvepoint = PointOnCurve(move_2.Geometry, parameter=0.5)
rad = Radians(Degrees=Slider(330, range=0..360))
yz_2 = YZPlane(Origin=curvepoint)
rotate = Rotate(Geometry=move_2.Geometry, Angle=rad, Plane=yz_2)  # -> Geometry, Transform

curvepoint_2 = PointOnCurve(move_2.Geometry, parameter=0.5)
rad_2 = Radians(Degrees=Slider(42, range=0..360))
yz_3 = YZPlane(Origin=curvepoint_2)
rotate_2 = Rotate(Geometry=move_2.Geometry, Angle=rad_2, Plane=yz_3)  # -> Geometry, Transform
merge_2 = Merge(Data1=rotate.Geometry, Data2=rotate_2.Geometry)  # -> graft(Result)

shatter = Shatter(Curve=reparameterize(merge_2), Parameters=remap.Mapped)
item_2 = ListItem(List=shatter, Index=0, Wrap=True)  # -> Item1, Item

divide = DivideCurve(Curve=item_2.Item1, Count=Slider(10, range=0..100), Kinks=False)  # -> flatten(Points), Tangents, Parameters
meshcp = MeshClosestPoint(Point=divide.Points, Mesh=mjoin)  # -> simplify(Point), Index, Parameter
pt_2 = Point(meshcp.Point)

# ---- group: COLOR MESH
demesh = DeconstructMesh(Mesh=mjoin)  # -> Vertices, Faces, Colours, Normals
pull = PullPoint(Point=demesh.Vertices, Geometry=merge, ClosestOnly=True)  # -> ClosestPoint, Distance

# ----
sin = Sine(Value=pull.Distance)
multiplication = Multiplication(A=sin, B=Slider(7, range=0..10))

# ---- group: COLOR MESH (continued)
addition = Addition(A=multiplication, B=pull.Distance)
bnd_2 = Bounds(Numbers=addition)
dedomain = DeconstructDomain(Domain=bnd_2)  # -> Start, End
gradient = Gradient(
    LowerLimit=dedomain.Start,
    UpperLimit=dedomain.End,
    Parameter=addition,
    stops=[0.0465: RGB(0, 0, 0), 0.126: RGB(255, 255, 255), 0.235: RGB(0, 0, 0)])

# ----
pull_2 = PullPoint(Point=demesh.Vertices, Geometry=meshcp.Point, ClosestOnly=True)  # -> ClosestPoint, Distance
sin_2 = Sine(Value=pull_2.Distance)
multiplication_2 = Multiplication(A=sin_2, B=Slider(0, range=0..10))
addition_2 = Addition(A=multiplication_2, B=pull_2.Distance)
bnd_3 = Bounds(Numbers=addition_2)
dedomain_2 = DeconstructDomain(Domain=bnd_3)  # -> Start, End
gradient_2 = Gradient(
    LowerLimit=dedomain_2.Start,
    UpperLimit=dedomain_2.End,
    Parameter=addition_2,
    stops=[0: RGB(255, 255, 255), 0.0618: RGB(0, 0, 0)])

addition_3 = Addition(A=gradient, B=gradient_2)
conmesh = ConstructMesh(Vertices=demesh.Vertices, Faces=demesh.Faces, Colours=addition_3)

meshcp_2 = MeshClosestPoint(Point=project.Geometry, Mesh=mjoin)  # -> simplify(Point), Index, Parameter
item_3 = ListItem(List=demesh.Faces, Index=meshcp_2.Index, Wrap=True)
conmesh_2 = ConstructMesh(Vertices=demesh.Vertices, Faces=item_3, Colours=gradient)
facen = FaceNormals(Mesh=conmesh_2)  # -> Centers, Normals
pl = PlaneNormal(Origin=facen.Centers, ZAxis=facen.Normals)
cir = Circle(Plane=pl, Radius=Slider(10, range=0..10))
divide_2 = DivideCurve(Curve=cir, Count=Slider(20, range=0..100), Kinks=False)  # -> flatten(Points), Tangents, Parameters

merge_3 = Merge(Data1=divide_2.Points)  # -> flatten(Result)
pt_3 = Point(merge_3)
lng = ListLength(List=pt_3)
repeat = RepeatData(Data=Y, Length=lng)

rndvec = RandomVector(Number=lng, Unit=True, RandomSeed=2, AbsoluteMultiplier=1)
devec = DeconstructVector(Vector=rndvec)  # -> XComponent, YComponent, ZComponent
vec_2 = VectorXYZ(XComponent=devec.XComponent, YComponent=devec.YComponent, ZComponent=devec.ZComponent)  # -> unitize(simplify(Vector)), Length
merge_4 = Merge(Data1=simplify(graft(pt_3)), Data2=simplify(graft(vec_2.Vector)), Data3=simplify(graft(pt_3)))
group = Group(Objects=merge_4)  # -> flatten(Group)

demesh_2 = DeconstructMesh(Mesh=conmesh)  # -> Vertices, Faces, Colours, Normals
conmesh_3 = ConstructMesh(Vertices=demesh_2.Vertices, Faces=demesh_2.Faces, Colours=flatten(demesh_2.Colours))

button = Button()
maxforce = Slider(3, range=0..10)
futloc = Slider(5, range=0..10)
maxspeed = Slider(3, range=0..10)
exit = Button()

loop_start = LoopStart(Repeat=Slider(150, range=0..500), Trigger=button, Data=group)  # -> port, Counter, Data

panel = Panel(loop_start.Counter)

ungroup = Ungroup(Group=loop_start.Data)  # -> simplify(Objects)
split_2 = SplitList(List=ungroup, Index=Slider(2, range=0..10))  # -> simplify(ListA), simplify(ListB)
item_4 = ListItem(List=split_2.ListA, Index=0, Wrap=True)  # -> Item, Item1

# ----
# read environment
# future location
amp = Amplitude(Vector=item_4.Item1, Amplitude=futloc)
move_3 = Move(Geometry=item_4.Item, Motion=amp)  # -> Geometry, Transform
samples = Slider(5, range=3..10)
cps = ClosestPoints(Point=move_3.Geometry, Cloud=demesh_2.Vertices, Count=samples)  # -> ClosestPoint, CPIndex, Distance
item_5 = ListItem(List=demesh_2.Colours, Index=cps.CPIndex, Wrap=True)
ahsv = SplitAHSV(Colour=item_5)  # -> Alpha, Hue, Saturation, Value
sort = SortList(Keys=ahsv.Value, ValuesA=cps.ClosestPoint, ValuesB=cps.CPIndex)  # -> Keys, ValuesA, ValuesB
item_6 = ListItem(List=simplify(sort.ValuesA), Index=0, Wrap=True)  # -> Item1, Item
vec2pt = Vector2Pt(PointA=item_4.Item, PointB=item_6.Item1, Unitize=False)  # -> Vector, Length

steer = Steer(vel=item_4.Item1, des=vec2pt.Vector, maxv=maxspeed, maxf=maxforce)
multiplication_3 = Multiplication(A=steer, B=color_intensity)

addition_4 = Addition(A=item_4.Item1, B=multiplication_3)
trmvec = TrimVector(Vector=addition_4, LengthDomain=maxspeed)

move_4 = Move(Geometry=item_4.Item, Motion=trmvec)  # -> Geometry, Transform
panel_2 = Panel(trmvec)
meshcp_3 = MeshClosestPoint(Point=move_4.Geometry, Mesh=conmesh_3)  # -> simplify(Point), Index, Parameter

merge_5 = Merge(Data1=simplify(split_2.ListB), Data2=simplify(meshcp_3.Point))
merge_6 = Merge(Data1=simplify(move_4.Geometry), Data2=simplify(trmvec), Data3=simplify(merge_5))
group_2 = Group(Objects=merge_6)  # -> flatten(Group)

loop_end = LoopEnd(port=loop_start.port, Exit=exit, Data=group_2, pausedState=False, state="Constant output", TimeOutVal=0)
dam = DataDam(DataA=loop_end, BufferDelay=10000000, BufferMode=0)
ungroup_2 = Ungroup(Group=loop_end)
ungroup_3 = Ungroup(Group=dam)
split_3 = SplitList(List=ungroup_2, Index="2")  # -> ListA, ListB
pt_4 = Point(split_3.ListB)
pline = PolyLine(Vertices=pt_4, Closed=False)
split_4 = SplitList(List=ungroup_3, Index=Slider(2, range=0..10))  # -> ListA, ListB
preview = CustomPreview(Geometry=pline, Shader=ColourSwatch(SwatchColor=RGB(0, 34, 255)))

area_2 = Area(Geometry=conmesh)  # -> Area, Centroid
yz_4 = YZPlane(Origin=area_2.Centroid)
mirror = Mirror(Geometry=split_4.ListB, Plane=yz_4)  # -> simplify(Geometry), Transform
tstat = TreeStatistics(Tree=mirror.Geometry)  # -> Paths, Length, Count

lng_2 = ListLength(List=tstat.Paths)
series_2 = Series(Start=lng_2, Step=1, Count=lng_2)
int = Integer(graft(series_2))
path = ConstructPath(Indices=int)  # -> flatten(Branch)
replace = ReplacePaths(Data=mirror.Geometry, Search=tstat.Paths, Replace=path)
merge_7 = Merge(Data1=simplify(split_4.ListB), Data2=simplify(replace))

# ---- group: FINDING NORMALS
nurbs = NurbsCurve(Vertices=merge_7, Degree=Slider(3, range=0..10), Periodic=False)  # -> Curve, Length, Domain
crv_cp = CurveClosestPoint(Point=merge_7, Curve=nurbs.Curve)  # -> Point, Parameter, Distance
mjoin_2 = MeshJoin(Meshes=mesh)
meshcp_4 = MeshClosestPoint(Point=crv_cp.Point, Mesh=mjoin_2)  # -> Point, Index, simplify(Parameter)
meval = MeshEval(Mesh=mjoin_2, Parameter=meshcp_4.Parameter)  # -> Point, Normal, Colour
line = LineSDL(Start=meshcp_4.Point, Direction=meval.Normal, Length=Slider(10, range=0..10))

# ----
lng_3 = ListLength(List=line)
dom_2 = ConstructDomain(DomainStart=0, DomainEnd=Slider(15, range=0..100))
range = Range(Domain=dom_2, Steps=expr("X-1", lng_3))
sin_3 = Sine(Value=range)
abs = Absolute(Value=sin_3)
multiplication_4 = Multiplication(A=abs, B=range)  # -> simplify(Result)
amp_2 = Amplitude(Vector=meval.Normal, Amplitude=multiplication_4)
move_5 = Move(Geometry=meshcp_4.Point, Motion=amp_2)  # -> Geometry, Transform

nurbs_2 = NurbsCurve(Vertices=merge_7, Degree=Slider(10, range=0..10), Periodic=False)  # -> flatten(Curve), Length, Domain
nurbs_3 = NurbsCurve(Vertices=move_5.Geometry, Degree=3, Periodic=False)  # -> Curve, Length, Domain
crv_2 = Curve(nurbs_3.Curve)

curvepoint_3 = PointOnCurve(crv_2, parameter=0.503)
pdecon = Deconstruct(Point=curvepoint_3)  # -> XComponent, YComponent, ZComponent
sort_2 = SortList(Keys=pdecon.ZComponent)  # -> reverse(Keys), reverse(ValuesA)
bnd_4 = Bounds(Numbers=flatten(sort_2.Keys))
dom_3 = ConstructDomain(DomainStart=Slider(3.8, range=0..10), DomainEnd=Slider(4, range=0..10))
remap_2 = RemapNumbers(Value=sort_2.Keys, Source=bnd_4, Target=dom_3)  # -> flatten(Mapped), Clipped
execute = BooleanToggle(True)
list = ValueList({"None": 0, "Front to Back": 1, "Both Ends": 2}, selected="Both Ends")
geometry_wrapper = VBScript(
    G=flatten(crv_2),
    R=remap_2.Mapped,
    res=Slider(1, range=0..1),
    iso=Slider(0.5, range=0..1),
    smooth=Slider(0, range=0..10),
    taper=list,
    ratio=Slider(0.6, range=0..1),
    run=execute)  # -> out, mc; inputs G: list, R: list
# ---------- geometry_wrapper: VB ----------
    If run = True Then

      'set edge and triangle tables from the inestimable PaulBourke.net
      intEdgeTable = {&H0, &H109, &H203, &H30a, &H406, &H50f, &H605, &H70c,&H80c, &H905, &Ha0f, &Hb06, &Hc0a, &Hd03, &He09, &Hf00,&H190, &H99 , &H393, &H29a, &H596, &H49f, &H795, &H69c,&H99c, &H895, &Hb9f, &Ha96, &Hd9a, &Hc93, &Hf99, &He90,&H230, &H339, &H33 , &H13a, &H636, &H73f, &H435, &H53c,&Ha3c, &Hb35, &H83f, &H936, &He3a, &Hf33, &Hc39, &Hd30,&H3a0, &H2a9, &H1a3, &Haa , &H7a6, &H6af, &H5a5, &H4ac,&Hbac, &Haa5, &H9af, &H8a6, &Hfaa, &Hea3, &Hda9, &Hca0,&H460, &H569, &H663, &H76a, &H66 , &H16f, &H265, &H36c,&Hc6c, &Hd65, &He6f, &Hf66, &H86a, &H963, &Ha69, &Hb60,&H5f0, &H4f9, &H7f3, &H6fa, &H1f6, &Hff , &H3f5, &H2fc,&Hdfc, &Hcf5, &Hfff, &Hef6, &H9fa, &H8f3, &Hbf9, &Haf0,&H650, &H759, &H453, &H55a, &H256, &H35f, &H55 , &H15c,&He5c, &Hf55, &Hc5f, &Hd56, &Ha5a, &Hb53, &H859, &H950,&H7c0, &H6c9, &H5c3, &H4ca, &H3c6, &H2cf, &H1c5, &Hcc ,&Hfcc, &Hec5, &Hdcf, &Hcc6, &Hbca, &Hac3, &H9c9, &H8c0,&H8c0, &H9c9, &Hac3, &Hbca, &Hcc6, &Hdcf, &Hec5, &Hfcc,&Hcc , &H1c5, &H2cf, &H3c6, &H4ca, &H5c3, &H6c9, &H7c0,&H950, &H859, &Hb53, &Ha5a, &Hd56, &Hc5f, &Hf55, &He5c,&H15c, &H55 , &H35f, &H256, &H55a, &H453, &H759, &H650,&Haf0, &Hbf9, &H8f3, &H9fa, &Hef6, &Hfff, &Hcf5, &Hdfc,&H2fc, &H3f5, &Hff , &H1f6, &H6fa, &H7f3, &H4f9, &H5f0,&Hb60, &Ha69, &H963, &H86a, &Hf66, &He6f, &Hd65, &Hc6c,&H36c, &H265, &H16f, &H66 , &H76a, &H663, &H569, &H460,&Hca0, &Hda9, &Hea3, &Hfaa, &H8a6, &H9af, &Haa5, &Hbac,&H4ac, &H5a5, &H6af, &H7a6, &Haa , &H1a3, &H2a9, &H3a0,&Hd30, &Hc39, &Hf33, &He3a, &H936, &H83f, &Hb35, &Ha3c,&H53c, &H435, &H73f, &H636, &H13a, &H33 , &H339, &H230,&He90, &Hf99, &Hc93, &Hd9a, &Ha96, &Hb9f, &H895, &H99c,&H69c, &H795, &H49f, &H596, &H29a, &H393, &H99 , &H190,&Hf00, &He09, &Hd03, &Hc0a, &Hb06, &Ha0f, &H905, &H80c,&H70c, &H605, &H50f, &H406, &H30a, &H203, &H109, &H0}
      intTriTable= {{-1, -1, -1, -1, -1, -1, -1, -1, -1, -1, -1, -1, -1, -1, -1, -1},{0, 8, 3, -1, -1, -1, -1, -1, -1, -1, -1, -1, -1, -1, -1, -1},{0, 1, 9, -1, -1, -1, -1, -1, -1, -1, -1, -1, -1, -1, -1, -1},{1, 8, 3, 9, 8, 1, -1, -1, -1, -1, -1, -1, -1, -1, -1, -1},{1, 2, 10, -1, -1, -1, -1, -1,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

      use_iso = iso
      TaperCurves = taper
      TaperRatio = ratio
      If ratio < 0 Then
        TaperRatio = 0
      ElseIf ratio > 1 Then
        TaperRatio = 1
      End If

      'setup point and curve geometry sources
      Dim crvSource As New List(Of Curve)
      Dim crvRad As New List(Of Double)

      Dim ptSource As New List(Of Point3d)
      Dim ptRad As New List(Of Double)

      Dim brpSource As New List(Of Brep)
      Dim brpMesh As New List(Of Mesh)
      Dim brpRad As New List(Of Double)

      Dim radCounter As Int32 = -1

      For Gi As Int32 = 0 To G.Count - 1

        If GI <= R.Count - 1 Then
          radCounter += 1
        End If

        Dim crv As Curve = TryCast(G(Gi), Curve)
        If crv IsNot Nothing Then
          crv.Domain = New Interval(0, 1)
          crvSource.Add(Crv)
          crvRad.Add(R(radCounter))
        Else
          If TypeOf(G(Gi)) Is Line Then
          Dim lin As Line = DirectCast(G(Gi), Line)
          Dim lc As New LineCurve(lin)
            lc.Domain = New Interval(0, 1)
            crvSource.Add(lc)
            crvRad.Add(R(radCounter))
          Else
            Dim brp As Brep = TryCast(G(Gi), Brep)
            If brp IsNot Nothing Then
              brpSource.Add(brp)
              brpRad.Add(R(radCounter))
              Dim msh() As Mesh = Mesh.CreateFromBrep(brp)
              Dim mshSet As New Mesh
              For Each mshAdd As Mesh In msh
                mshSet.Append(mshAdd)
              Next
              refine_mesh(mshSet)
              brpMesh.Add(mshSet)
            Else
              ptSource.Add(G(Gi))
              ptRad.Add(R(radCounter))
            End If
          End If
        End If

      Next

      'charge sphere lookup data for both the rTree and the bounding box for the sample point 3D grid
      Dim pt As New List(Of Point3d)
      Dim rad As New List(Of Double)
      Dim tgtType As New List(Of Int32)
      Dim tgtIdx As New List(Of int32)

      For crvi As Int32 = 0 To crvSource.Count - 1 'assign series of spheres along curve for identifying sample points for inclusion
        Dim crv As Curve = crvSource(crvi)
        Dim t() As Double = crv.DivideByCount(crv.GetLength / crvRad(crvi), True)
        Dim SphereRad As Double = Math.Sqrt(crvRad(crvi) ^ 2 + (crvRad(crvi) / 2) ^ 2) * 1.3
        For Each tSet As Double In t
          Dim ptAdd As Point3d = crv.PointAt(tSet)
          Dim blAdd As Boolean = True

          If blAdd = True Then

            pt.Add(ptAdd)
            rad.Add(SphereRad)
            tgtType.Add(0)
            tgtIdx.Add(crvi)

          End If
        Next
      Next

      For pti As Int32 = 0 To ptSource.Count - 1
        pt.Add(ptSource(pti))
        rad.Add(ptRad(pti) * 1.3)
        tgtType.Add(1)
        tgtIdx.Add(pti)
      Next

      For brpi As Int32 = 0 To brpSource.Count - 1

        Dim brpCrvs() As Curve = brpSource(brpi).DuplicateEdgeCurves

        For crvi As Int32 = 0 To brpCrvs.Length - 1 'assign series of spheres along curve for identifying sample points for inclusion
          Dim crv As Curve = brpCrvs(crvi)
          Dim t() As Double = crv.DivideByCount(crv.GetLength / brpRad(brpi), True)
          Dim SphereRad As Double = Math.Sqrt(brpRad(brpi) ^ 2 + (brpRad(brpi) / 2) ^ 2) * 1.3
          For Each tSet As Double In t
            pt.Add(crv.PointAt(tSet))
            rad.Add(SphereRad)
            tgtType.Add(2)
            tgtIdx.Add(brpi)
          Next
        Next

        For fi As int32 = 0 To brpSource(brpi).Faces.Count - 1

          Dim bface As BrepFace = brpSource(brpi).Faces(fi)
          Dim SphereRad As Double = Math.Sqrt(brpRad(brpi) ^ 2 + (brpRad(brpi) / 2) ^ 2) * 1.3

          Dim w,h As Double
          bface.GetSurfaceSize(w, h)
          Dim ui As Double = w / brpRad(brpi)
          Dim vi As Double = h / brpRad(brpi)

          For u As Int32 = 0 To ui
            For v As Int32 = 0 To vi
              If bface.IsPointOnFace(bface.Domain(0).ParameterAt(u / ui), bface.Domain(1).ParameterAt(v / vi)) Then
                pt.Add(bface.PointAt(bface.Domain(0).ParameterAt(u / ui), bface.Domain(1).ParameterAt(v / vi)))
                rad.Add(SphereRad)
                tgtType.Add(2)
                tgtIdx.Add(brpi)
              End If
            Next
          Next

        Next

      Next


      'generate box orienting plane
      Dim pl As Plane = Nothing
      Plane.FitPlaneToPoints(pt, pl)
      pl.Origin = pt(0)
      '
      'generate bounding box
      Dim dom As New interval(-rad(0), rad(0))
      Dim b As New Box(pl, dom, dom, dom)
      '
      For set_s As Int32 = 1 To pt.Count - 1
        pl.Origin = pt(set_s)
        b.Union(pl.PointAt(-rad(set_s), -rad(set_s), -rad(set_s)))
        b.Union(pl.PointAt(rad(set_s), rad(set_s), rad(set_s)))
      Next

      b.Inflate(res * 3)
      Dim rt As New RTree 'the RTree used for assigning sample points to appropriate point/curve charges

      'calculate sample point grid size relative to the xyz of the oriented bounding box
      Dim xSet As Int32 = b.X.Length / res
      Dim ySet As Int32 = b.Y.Length / res
      Dim zSet As Int32 = b.Z.Length / res
      Dim xLength As Double = b.X.Length / xSet
      Dim yLength As Double = b.Y.Length / ySet
      Dim zLength As Double = b.Z.Length / zSet
      Dim xOffset As Double = xLength / 2
      Dim yOffset As Double = yLength / 2
      Dim zOffset As Double = zLength / 2

      pl.Origin = b.GetCorners(0)

      Dim bCornerLookup(xSet*ySet*zSet-1, 7) As Int32 'array of corner indices for each cell
      Dim bCenterIdx As Int32 = 0

      Dim bCorners As New List(Of Point3d) 'list of all cell corners
      Dim bCornerField((xSet+1)*(ySet+1)*(zSet+1)-1) As Double
      Dim bCornerIdx As Int32 = 0

      'Setup rTree with center points of each cell, all cell corner points and indices of corners for each cell for looking up iso calc

      For xRun As Int32 = 0 To xSet
        For yRun As Int32 = 0 To ySet
          For zRun As Int32 = 0 To zSet
            If xRun < xSet And yRun < ySet And zRun < zSet Then

              'setting up cell centers and assigning index array for all associated sample points

              Dim bCenter As Point3d = pl.PointAt(xOffset + (xLength * xRun), yOffset + (yLength * yRun), zOffset + (zLength * zRun))
              rt.Insert(bCenter, bCenterIdx)

              Dim lc As Int32 = bCornerIdx
              Dim rc As Int32 = lc + ((ySet + 1) * (zSet + 1))

              bCornerLookup(bCenterIdx, 0) = lc + zSet + 1
              bCornerLookup(bCenterIdx, 1) = rc + zSet + 1
              bCornerLookup(bCenterIdx, 2) = rc
              bCornerLookup(bCenterIdx, 3) = lc
              bCornerLookup(bCenterIdx, 4) = lc + zSet + 2
              bCornerLookup(bCenterIdx, 5) = rc + zSet + 2
              bCornerLookup(bCenterIdx, 6) = rc + 1
              bCornerLookup(bCenterIdx, 7) = lc + 1

              bCenterIdx += 1

            End If

            'sample points
            Dim bCorner As Point3d = pl.PointAt(xLength * xRun, yLength * yRun, zLength * zRun)
            bCorners.Add(bCorner)

            bCornerIdx += 1
          Next
        Next
      Next

      Dim MchCube As New Mesh

      'create a list of corner field values to calculate
      Dim CalcIndices As New DataTree(Of Int32) 'a data tree of sample points to be calculated, assigned according to charge
      'type and index, and cleaned of all duplicate values
      Dim CalcIndicesStart As New List(Of Int32) 'an initial list of sample points to be calculated, with potential duplicates

      Dim CenterTargetRaw As New List(Of Int32)
      Dim CenterTargetRefined As New List(Of Int32)

      For rti As int32 = 0 To pt.Count - 1 'cycle through all charge points

        'for each curve, there are multiple charge point spheres that need to be assessed

        If rti > 0 Then 'after the first charge is assessed, it is determined at each cycle if the charge is part of the same
          'input curve geometry...if it is part of a new one, then append the cleaned sample point indices, otherwise, continue
          'evaluating sample points
          If tgtType(rti) <> tgtType(rti - 1) Or tgtIdx(rti) <> tgtIdx(rti - 1) Then
            CalcIndices.AddRange(CalcIndicesStart.Distinct.ToList, New GH_Path(tgtType(rti - 1), tgtIdx(rti - 1)))
            CalcIndicesStart.Clear
          End If
        End If

        'use the rTree to test proximity of cell centers to charge points...for all cell centers within the assigned radius of
        'each charge point
        Dim DataSet As New search_data(pt(rti))
        If rt.Search(New Sphere(pt(rti), rad(rti)), AddressOf search_call, DataSet) = True Then
          If DataSet.target_idc.Count > 0 Then
            For Each target_idx As Int32 In DataSet.target_idc
              For i As int32 = 0 To 7
                CalcIndicesStart.Add(bCornerLookup(target_idx, i))
                CenterTargetRaw.Add(target_idx)
              Next
            Next
          End If
        End If

        'at the last cycle, append the last list
        If rti = pt.Count - 1 Then
          CalcIndices.AddRange(CalcIndicesStart.Distinct.ToList, New GH_Path(tgtType(rti), tgtIdx(rti)))
        End If

      Next

      'list of all unique cells that will need to be assessed
      CenterTargetRefined.AddRange(CenterTargetRaw.Distinct.ToList)

      'field calculations for all relevant charge/sample point relationships
      For Each p As GH_Path In CalcIndices.Paths

        Dim CI As List(Of Int32) = CalcIndices.Branch(p)

        If p.Indices(0) = 0 Then 'it's a curve

          Dim crv As Curve = crvSource(p.Indices(1))
          Dim radius As Double = crvRad(p.Indices(1))

          For Each CalcIndex As Int32 In CI
            bCornerField(CalcIndex) += calculate_crv_field(bCorners(CalcIndex), crv, radius)
          Next

        ElseIf p.Indices(0) = 1 Then 'it's a point

          Dim center As Point3d = ptSource(p.Indices(1))
          Dim radius As Double = ptRad(p.Indices(1))

          For Each CalcIndex As Int32 In CI
            bCornerField(CalcIndex) += calculate_pt_field(bCorners(CalcIndex), center, radius)
          Next

        Else 'it's a brep

          Dim brp As Brep = brpSource(p.Indices(1))
          Dim msh As Mesh = brpMesh(p.Indices(1))
          Dim radius As Double = brpRad(p.Indices(1))

          For Each CalcIndex As Int32 In CI
            bCornerField(CalcIndex) += calculate_brp_field(bCorners(CalcIndex), msh, radius)
          Next

        End If

      Next

      For Each CenterTarget As Int32 In CenterTargetRefined

        Dim CList As New List(Of Point3d)
        Dim CField As New List(Of Double)

        For i As Int32 = 0 To 7

          CList.Add(bCorners(bCornerLookup(CenterTarget, i)))
          CField.Add(bCornerField(bCornerLookup(CenterTarget, i)))

        Next

        Dim TriMesh As Mesh = local_cube(CList, CField)
        MchCube.append(TriMesh)

      Next

      refine_mesh(MchCube)

      Dim DisjointMesh() As Mesh = mchCube.SplitDisjointPieces
      For Each M As Mesh In DisjointMesh
        refine_mesh(M)
        For s As int32 = 0 To smooth - 1
          SmoothMesh(M)
        Next
      Next

      mc = DisjointMesh

    End If
# ---------- geometry_wrapper: VB additional code ----------
  Public intEdgeTable(255) As Int32
  Public intTriTable(255, 15) As Int32
  Public use_iso As Double
  Public TaperCurves As Int32
  Public TaperRatio As Double

  Function local_cube(ByVal c As List(Of Point3d), ByVal c_v As List(Of Double)) As Mesh

    'marching cube algorithm
    'adapted from the c++ script by Paul Bourke:
    'http://paulbourke.net/geometry/polygonise/

    Dim cubeindex As Int32
    If c_v(0) < use_iso Then cubeindex = cubeindex Or 1
    If c_v(1) < use_iso Then cubeindex = cubeindex Or 2
    If c_v(2) < use_iso Then cubeindex = cubeindex Or 4
    If c_v(3) < use_iso Then cubeindex = cubeindex Or 8
    If c_v(4) < use_iso Then cubeindex = cubeindex Or 16
    If c_v(5) < use_iso Then cubeindex = cubeindex Or 32
    If c_v(6) < use_iso Then cubeindex = cubeindex Or 64
    If c_v(7) < use_iso Then cubeindex = cubeindex Or 128

    Dim vertlist(11) As Point3d

    If intEdgeTable(cubeindex) And 1 Then vertlist(0) = interp_vertex(c(0), c(1), c_v(0), c_v(1))
    If intEdgeTable(cubeindex) And 2 Then vertlist(1) = interp_vertex(c(1), c(2), c_v(1), c_v(2))
    If intEdgeTable(cubeindex) And 4 Then vertlist(2) = interp_vertex(c(2), c(3), c_v(2), c_v(3))
    If intEdgeTable(cubeindex) And 8 Then vertlist(3) = interp_vertex(c(3), c(0), c_v(3), c_v(0))
    If intEdgeTable(cubeindex) And 16 Then vertlist(4) = interp_vertex(c(4), c(5), c_v(4), c_v(5))
    If intEdgeTable(cubeindex) And 32 Then vertlist(5) = interp_vertex(c(5), c(6), c_v(5), c_v(6))
    If intEdgeTable(cubeindex) And 64 Then vertlist(6) = interp_vertex(c(6), c(7), c_v(6), c_v(7))
    If intEdgeTable(cubeindex) And 128 Then vertlist(7) = interp_vertex(c(7), c(4), c_v(7), c_v(4))
    If intEdgeTable(cubeindex) And 256 Then vertlist(8) = interp_vertex(c(0), c(4), c_v(0), c_v(4))
    If intEdgeTable(cubeindex) And 512 Then vertlist(9) = interp_vertex(c(1), c(5), c_v(1), c_v(5))
    If intEdgeTable(cubeindex) And 1024 Then vertlist(10) = interp_vertex(c(2), c(6), c_v(2), c_v(6))
    If intEdgeTable(cubeindex) And 2048 Then vertlist(11) = interp_vertex(c(3), c(7), c_v(3), c_v(7))

    Dim box_mesh As New Mesh()

    For i As int32 = 0 To 16 Step 3
      If intTriTable(cubeindex, i) = -1 Then Exit For
      box_mesh.Vertices.Add(vertlist(intTriTable(cubeindex, i)))
      box_mesh.Vertices.Add(vertlist(intTriTable(cubeindex, i + 1)))
      box_mesh.Vertices.Add(vertlist(intTriTable(cubeindex, i + 2)))
      box_mesh.Faces.AddFace(New MeshFace(i + 2, i + 1, i))
    Next

    Return box_mesh

  End Function

  Function interp_vertex(ByVal p1 As Point3d, ByVal p2 As Point3d, ByVal v1 As Double, ByVal v2 As Double) As Point3d
    Return New Point3d(P1 + (use_iso - v1) / (v2 - v1) * (p2 - p1))
  End Function

  Function calculate_brp_field(ByVal test_pt As Point3d, ByVal msh As Mesh, ByVal radius As Double) As Double
    'metaball field calculations
    'based on methods described by Paul Bourke:
    'http://paulbourke.net/geometry/implicitsurf/

    Dim field_value As Double = 0
    Dim test_dist As Double = msh.ClosestPoint(test_pt).DistanceTo(test_pt)

    If test_dist > 0 And test_dist < radius / 3 Then
      field_value += 1 * (1 - 3 * test_dist ^ 2 / radius ^ 2)
    ElseIf test_dist >= radius / 3 And test_dist < radius Then
      field_value += (3 / 2) * (1 - test_dist / radius) ^ 2
    End If
    Return field_value

  End Function

  Function calculate_crv_field(ByVal test_pt As Point3d, ByVal crv As Curve, ByVal radius As Double) As Double
    'metaball field calculations
    'based on methods described by Paul Bourke:
    'http://paulbourke.net/geometry/implicitsurf/

    Dim field_value As Double = 0

    Dim t As Double
    crv.ClosestPoint(test_pt, t)
    Dim test_dist As Double = crv.PointAt(t).DistanceTo(test_pt)

    'if the curves are to be tapered, adjust the radius calculation
    'relative To the closest point along the charge curve

    If TaperCurves = 1 Then
      radius = (radius * (TaperRatio + 0.01)) + (radius * (1 - t) * (1 - TaperRatio))
    ElseIf TaperCurves = 2 Then
      radius = (radius * ((1 - TaperRatio) + 0.01)) + (radius * (1 - Math.Abs(0.5 - t)) * (TaperRatio))
    End If

    If test_dist > 0 And test_dist < radius / 3 Then
      field_value += 1 * (1 - 3 * test_dist ^ 2 / radius ^ 2)
    ElseIf test_dist >= radius / 3 And test_dist < radius Then
      field_value += (3 / 2) * (1 - test_dist / radius) ^ 2
    End If
    Return field_value

  End Function

  Function calculate_pt_field(ByVal test_pt As Point3d, ByVal center As Point3d, ByVal radius As Double) As Double
    'metaball field calculations
    'based on methods described by Paul Bourke:
    'http://paulbourke.net/geometry/implicitsurf/

    Dim field_value As Double = 0

    Dim test_dist As Double = test_pt.DistanceTo(center)

    If test_dist > 0 And test_dist < radius / 3 Then
      field_value += 1 * (1 - 3 * test_dist ^ 2 / radius ^ 2)
    ElseIf test_dist >= radius / 3 And test_dist < radius Then
      field_value += (3 / 2) * (1 - test_dist / radius) ^ 2
    End If

    Return field_value
  End Function

  Public Sub search_call(ByVal sender As Object, ByVal e As RTreeEventArgs)
    Dim data As search_data = TryCast(e.Tag, search_data)
    data.target_idc.Add(e.Id)
  End Sub

  Public Class search_data

    Public Sub New(ByVal get_search_node As Point3d)
      search_node = get_search_node
    End Sub

    Public search_node As Point3d
    Public target_idc As New List(Of Int32)

  End Class

  Function refine_mesh(ByRef msh As Mesh) As Boolean
    msh.Vertices.CombineIdentical(True, True)
    msh.FaceNormals.ComputeFaceNormals()
    msh.Normals.ComputeNormals()
    msh.UnifyNormals()
    Return True
  End Function

  Function SmoothMesh(ByRef msh As Mesh) As Boolean

    Dim vertices() As Point3d = msh.Vertices.ToPoint3dArray
    Dim set_vertices() As Point3d = msh.Vertices.ToPoint3dArray

    For v As int32 = 0 To msh.TopologyVertices.Count - 1

      Dim neighbors() As Int32 = msh.TopologyVertices.ConnectedTopologyVertices(v)
      Dim center As Int32 = msh.TopologyVertices.MeshVertexIndices(v)(0)

      Dim reset_center As New Point3d(0, 0, 0)
      Dim counter As Int32 = 0
      For Each neighbor As int32 In neighbors
        Dim reset_vertex As Int32 = msh.TopologyVertices.MeshVertexIndices(neighbor)(0)
        If reset_vertex <> center Then
          reset_center += vertices(reset_vertex)
          counter += 1
        End If
      Next

      set_vertices(center) = reset_center / counter
      set_vertices(center) = msh.ClosestPoint(set_vertices(center))

    Next

    For v As int32 = 0 To msh.Vertices.count - 1
      msh.Vertices(v) = New Point3f(set_vertices(v).X, set_vertices(v).Y, set_vertices(v).Z)
    Next

    Return True

  End Function
# ---------- end geometry_wrapper ----------

panel_3 = Panel(geometry_wrapper.mc)
preview_2 = CustomPreview(Geometry=geometry_wrapper.mc, Shader=ColourSwatch(SwatchColor=RGB(255, 255, 255)))

wbcatmullclark = WeaverbirdsCatmullClarkSubdivision(MeshCurves=geometry_wrapper.mc, Level=1, SmoothNakedEdges=1)  # -> flatten(OutputMeshCurves)
mjoin_3 = MeshJoin(Meshes=wbcatmullclark)
demesh_3 = DeconstructMesh(Mesh=mjoin_3)  # -> Vertices, Faces, Colours, Normals
conmesh_4 = ConstructMesh(Vertices=demesh_3.Vertices, Faces=demesh_3.Faces, Colours=demesh_3.Normals)

# ==== cluster Steer
maxf = ClusterInput()
vel = ClusterInput()
maxv = ClusterInput()
des = ClusterInput()
amp = Amplitude(Vector=des, Amplitude=maxv)
subtraction = Subtraction(A=amp, B=vel)
multiplication = Multiplication(A=subtraction, B=maxf)
vlen = VectorLength(Vector=multiplication)
min = Minimum(A=vlen, B=maxv)
amp_2 = Amplitude(Vector=multiplication, Amplitude=min)
acc = ClusterOutput(amp_2)
