# Grasshopper definition 160614_IMP_00.gh (Grasshopper 0.9.76)
# plug-ins: Anemone

pt = ConstructPoint(XCoordinate=0, YCoordinate=0, ZCoordinate=0)  # disabled

# ---- group: magnetic field
number_slider = Slider(-10, range=-10..0)  # disabled
number_slider_2 = Slider(6, range=0..10)  # disabled
pt_2 = Point(<point referenced from the Rhino model>)  # disabled
swatch = ColourSwatch(SwatchColor=RGB(255, 0, 0))  # disabled
pt_3 = Point(Point(119.1932564, 78.75243344, 0))  # disabled
number_slider_3 = Slider(10, range=0..10)  # disabled
swatch_2 = ColourSwatch(SwatchColor=RGB(0, 106, 255))  # disabled
crv = Curve(<curve referenced from the Rhino model>)  # disabled
preview = CustomPreview(Geometry=pt_3, Shader=swatch_2)  # disabled
preview_2 = CustomPreview(Geometry=pt_2, Shader=swatch)  # disabled
pop2d = Populate2D(Region=crv, Count=100, Seed=number_slider_2)  # disabled
pcharge = PointCharge(Point=pt_2, Charge=number_slider, Decay=2)  # disabled
pcharge_2 = PointCharge(Point=pt_3, Charge=number_slider_3, Decay=2)  # disabled
mergef = MergeFields(Fields=[pcharge_2, pcharge])  # disabled
number_slider_4 = Slider(62, range=0..220)  # disabled
evf = EvaluateField(Field=mergef, Point=pop2d)  # -> Tensor, Strength; disabled
amp = Amplitude(Vector=evf.Tensor, Amplitude=number_slider_4)  # disabled
move = Move(Geometry=pop2d, Motion=amp)  # -> Geometry, Transform; disabled
vdis = VectorDisplay(Anchor=pop2d, Vector=amp)  # disabled

# ----
number_slider_5 = Slider(20, range=0..100)  # disabled
pt_4 = Point(pt)  # disabled
pt_5 = Point()  # disabled
cir = Circle(Plane=PlaneXY(0, 0, 0), Radius=Slider(10, range=0..10))
number_slider_6 = Slider(1, range=0..1)  # disabled
number_slider_7 = Slider(10, range=0..10)  # disabled
number_slider_8 = Slider(100, range=0..100)  # disabled
loop_start = LoopStart(Repeat=Slider(100, range=0..100), Data=cir)  # -> port, Counter, Data
pt_6 = Point(<point referenced from the Rhino model>)  # disabled
loop_start_2 = LoopStart(Repeat=number_slider_5, Data=pt_4)  # -> port, Counter, Data; disabled

number_slider_9 = Slider(15, range=0..100)  # disabled
pt_7 = ConstructPoint(XCoordinate=number_slider_9, YCoordinate=0, ZCoordinate=0)  # disabled
number_slider_10 = Slider(5, range=0..10)  # disabled
msphere = MeshSphere(Base=pt_7, Radius=number_slider_10, UCount=10, VCount=20)  # disabled

X = UnitX(Factor=number_slider_7)  # disabled
loop_start_3 = LoopStart(Repeat=number_slider_8, Data=number_slider_6)  # -> port, Counter, Data; disabled
number_slider_11 = Slider(10, range=0..10)  # disabled
divide = DivideCurve(Curve=loop_start.Data, Count=Slider(60, range=0..100), Kinks=False)  # -> Points, Tangents, Parameters
move_2 = Move(Geometry=pt_6, Motion=X)  # -> Geometry, Transform; disabled

number_slider_12 = Slider(1, range=0..1)  # disabled
addition = Addition(A=loop_start_3.Data, B=number_slider_12)  # disabled

X_2 = UnitX(Factor=number_slider_11)  # disabled
lng = ListLength(List=divide.Points)
panel = Panel(lng)
avr = Average(Input=divide.Points)
vec2pt = Vector2Pt(PointA=avr, PointB=divide.Points, Unitize=False)  # -> Vector, Length
move_3 = Move(Geometry=loop_start_2.Data, Motion=X_2)  # -> Geometry, Transform; disabled
number_slider_13 = Slider(3, range=0..10)
dom = ConstructDomain(DomainStart=Slider(0.2, range=0..0.5), DomainEnd=Slider(1, range=0..1))
random = Random(Range=dom, Number=lng, Seed=loop_start.Counter)
minc = MeshInclusion(Mesh=msphere, Point=move_3.Geometry, Strict=False)  # disabled
loop_end = LoopEnd(port=loop_start_3.port, Exit=False, Data=addition, pausedState=False, state="Constant output", TimeOutVal=0)  # disabled
panel_2 = Panel(random)
amp_2 = Amplitude(Vector=vec2pt.Vector, Amplitude=random)
panel_3 = Panel(loop_end)  # disabled
vdis_2 = VectorDisplay(Anchor=avr, Vector=amp_2)
loop_end_2 = LoopEnd(port=loop_start_2.port, Exit=minc, Data=move_3.Geometry, pausedState=False, state="Constant output", TimeOutVal=0)  # disabled
move_4 = Move(Geometry=divide.Points, Motion=amp_2)  # -> Geometry, Transform
nurbs = NurbsCurve(Vertices=move_4.Geometry, Degree=3, Periodic=Toggle(True))  # -> Curve, Length, Domain
loop_end_3 = LoopEnd(port=loop_start.port, Exit=False, Data=nurbs.Curve, pausedState=False, state="Constant & Record", TimeOutVal=0)  # -> flatten(Data)
lng_2 = ListLength(List=loop_end_3)
series = Series(Start=0, Step=1, Count=lng_2)  # -> reverse(Series)
Z = UnitZ(Factor=series)
move_5 = Move(Geometry=loop_end_3, Motion=Z)  # -> Geometry, Transform
loft = Loft(Curves=move_5.Geometry, Options={Adjust=False, Closed=False, LoftEnds=0, LoftSimp=0, LoftType=0, Rebuild=10, Refit=0.01})

number_slider_14 = Slider(-10, range=-10..0)  # disabled
number_slider_15 = Slider(6, range=0..10)  # disabled
pt_8 = Point(<point referenced from the Rhino model>)  # disabled
swatch_3 = ColourSwatch(SwatchColor=RGB(255, 0, 0))  # disabled
pt_9 = Point(Point(119.1932564, 78.75243344, 0))  # disabled
number_slider_16 = Slider(10, range=0..10)  # disabled
swatch_4 = ColourSwatch(SwatchColor=RGB(0, 106, 255))  # disabled
crv_2 = Curve(<curve referenced from the Rhino model>)  # disabled
preview_3 = CustomPreview(Geometry=pt_9, Shader=swatch_4)  # disabled
preview_4 = CustomPreview(Geometry=pt_8, Shader=swatch_3)  # disabled
pop2d_2 = Populate2D(Region=crv_2, Count=100, Seed=number_slider_15)  # disabled
pcharge_3 = PointCharge(Point=pt_8, Charge=number_slider_14, Decay=2)  # disabled
pcharge_4 = PointCharge(Point=pt_9, Charge=number_slider_16, Decay=2)  # disabled
number_slider_17 = Slider(10, range=0..10)  # disabled
mergef_2 = MergeFields(Fields=[pcharge_4, pcharge_3])  # disabled
loop_start_4 = LoopStart(Repeat=number_slider_17, Data=pop2d_2)  # -> port, Counter, Data; disabled

number_slider_18 = Slider(4, range=0..220)  # disabled
evf_2 = EvaluateField(Field=mergef_2, Point=loop_start_4.Data)  # -> Tensor, Strength; disabled
amp_3 = Amplitude(Vector=evf_2.Tensor, Amplitude=number_slider_18)  # disabled
move_6 = Move(Geometry=loop_start_4.Data, Motion=amp_3)  # -> Geometry, Transform; disabled
vdis_3 = VectorDisplay(Anchor=loop_start_4.Data, Vector=amp_3)  # disabled

loop_end_4 = LoopEnd(port=loop_start_4.port, Exit=False, Data=move_6.Geometry, pausedState=False, state="Constant output", TimeOutVal=0)  # disabled

# ---- group: intro to loops
number_slider_19 = Slider(20, range=0..100)  # disabled
pt_10 = Point(<point referenced from the Rhino model>)  # disabled
loop_start_5 = LoopStart(Repeat=number_slider_19, Data=pt_10)  # -> port, Counter, Data; disabled

number_slider_20 = Slider(10, range=0..10)  # disabled
X_3 = UnitX(Factor=number_slider_20)  # disabled
move_7 = Move(Geometry=loop_start_5.Data, Motion=X_3)  # -> Geometry, Transform; disabled

loop_end_5 = LoopEnd(port=loop_start_5.port, Exit=False, Data=move_7.Geometry, pausedState=False, state="Constant output", TimeOutVal=0)  # disabled
