# Grasshopper definition michel azzi , mohamad elatab reviewed.gh (Grasshopper 0.9.76)
# Copyright: Co-de-iT
# plug-ins: Anemone, Boid

crv = Curve(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)
end = EndPoints(Curve=crv)  # -> Start, End
project = Project(Geometry=end.End, Plane=PlaneXY(0, 0, 0))  # -> Geometry, Transform
project_2 = Project(Geometry=end.Start, Plane=PlaneXY(0, 0, 0))  # -> Geometry, Transform
pt = Point(Point(145.5769248, 73.85669694, 0))
pt_2 = Point(Point(-2.36462933, -22.07525394, 0))
amp = Amplitude(Vector=end.End, Amplitude=Slider(0, range=0..100))
move = Move(Geometry=crv, Motion=amp)  # -> Geometry, Transform
pipe = Pipe(Curve=crv, Radius=Slider(10, range=0..10), Caps=0)

# ---- group: the agent that will follow the trajectory
pt_3 = Point(Point(145.5769248, 346, 0))

# ---- group: the points that will follow the main agent
pt_4 = Point([Point(84, 574, 0), Point(136, 538, 0), Point(182, 635, 0), Point(116, 558, 0), Point(88, 468, 0), Point(162, 473, 0), Point(187, 543, 0), Point(157, 620, 0), Point(133, 648, 0), Point(91, 666, 0), Point(41, 631, 0), Point(44, 553, 0), Point(116, 558, 0), Point(144, 494, 0), Point(163, 573, 0), Point(121, 599, 0), Point(122, 492, 0)])

# ----
lng = ListLength(List=pt_3)
Y = UnitY(Factor=Slider(20, range=0..20))
lng_2 = ListLength(List=pt_4)
Y_2 = UnitY(Factor=Slider(12, range=0..20))
repeat = RepeatData(Data=Y, Length=lng)
repeat_2 = RepeatData(Data=Y_2, Length=lng_2)

# ---- group: the trajectory curve
crv_2 = Curve(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)

# ----
vec = Vector(repeat)
vec_2 = Vector(repeat_2)
flip = FlipCurve(Curve=crv_2)  # -> Curve, Flag
merge = Merge(Data1=simplify(graft(pt_3)), Data2=simplify(vec), Data3=simplify(pt_4), Data4=simplify(vec_2))  # -> simplify(flatten(Result))
number_slider = Slider(979, range=0..1000)
number_slider_2 = Slider(17, range=0..20)
group = Group(Objects=merge)
loop_start = LoopStart(Repeat=0, Trigger=Toggle(True), Data=group)  # -> port, Counter, simplify(Data)
item = ListItem(List=merge, Index=number_slider_2, Wrap=True)

ungroup = Ungroup(Group=loop_start.Data)
item_2 = ListItem(List=ungroup, Index=number_slider_2, Wrap=True)
item_3 = ListItem(List=ungroup, Index=Slider(18, range=0..100), Wrap=True)
vec_3 = Vector(simplify(flatten(item_3)))
pt_5 = Point(simplify(flatten(item_2)))

panel = Panel(ungroup)
panel_2 = Panel(vec_3)
panel_3 = Panel(pt_5)
dom = ConstructDomain(DomainStart=Slider(0, range=0..100), DomainEnd=Slider(16, range=0..100))
number_slider_3 = Slider(26, range=0..100)
number_slider_4 = Slider(26, range=0..100)

# ----
# the points that will
# follow the agent
# along the curve
# steer
panel_4 = Panel("""17
18""")
cull_i = CullIndex(List=ungroup, Indices=panel_4, Wrap=True)  # -> simplify(List)
split = SplitList(List=cull_i, Index=Slider(17, range=0..100))  # -> ListA, ListB
vec_4 = Vector(simplify(flatten(split.ListB)))
pt_6 = Point(simplify(flatten(split.ListA)))
number_slider_5 = Slider(2.5, range=0..10)
maxforce = Slider(0.539, range=0..1)
# steer
# steer
number_slider_6 = Slider(0.15, range=0..1)

amp_2 = Amplitude(Vector=vec_4, Amplitude=Slider(3, range=0..10))

move_2 = Move(Geometry=pt_6, Motion=amp_2)  # -> Geometry, Transform

crv_cp = CurveClosestPoint(Point=move_2.Geometry, Curve=graft(flip.Curve))  # -> Point, Parameter, Distance
eval = EvaluateCurve(Curve=flip.Curve, Parameter=crv_cp.Parameter)  # -> Point, Tangent, Angle

vec2pt = Vector2Pt(PointA=move_2.Geometry, PointB=crv_cp.Point, Unitize=False)  # -> Vector, Length
steer = Steer(vel=vec_4, des=vec2pt.Vector, maxv=number_slider_5, maxf=maxforce)
multiplication = Multiplication(A=steer, B=Slider(0.13, range=0..1))
multiplication_2 = Multiplication(A=eval.Tangent, B=number_slider_6)
addition = Addition(A=multiplication, B=multiplication_2)
addition_2 = Addition(A=vec_4, B=addition)
trmvec = TrimVector(Vector=addition_2, LengthDomain=number_slider_5)  # -> simplify(flatten(TrimmedVector))
move_3 = Move(Geometry=pt_6, Motion=trmvec)  # -> flatten(Geometry), Transform
panel_5 = Panel(move_3.Geometry)

amp_3 = Amplitude(Vector=vec_3, Amplitude=Slider(3, range=0..10))
move_4 = Move(Geometry=pt_5, Motion=amp_3)  # -> Geometry, Transform
crv_cp_2 = CurveClosestPoint(Point=move_4.Geometry, Curve=graft(flip.Curve))  # -> Point, Parameter, Distance
vec2pt_2 = Vector2Pt(PointA=move_4.Geometry, PointB=crv_cp_2.Point, Unitize=False)  # -> Vector, Length
number_slider_7 = Slider(9.2, range=0..10)
maxforce_2 = Slider(0.855, range=0..1)
eval_2 = EvaluateCurve(Curve=flip.Curve, Parameter=crv_cp_2.Parameter)  # -> Point, Tangent, Angle
multiplication_3 = Multiplication(A=eval_2.Tangent, B=Slider(0.15, range=0..1))

# ----
# steer
steer_2 = Steer(vel=vec_3, des=vec2pt_2.Vector, maxv=number_slider_7, maxf=maxforce_2)

multiplication_4 = Multiplication(A=steer_2, B=Slider(0.07, range=0..1))
addition_3 = Addition(A=multiplication_4, B=multiplication_3)
addition_4 = Addition(A=vec_3, B=addition_3)
trmvec_2 = TrimVector(Vector=addition_4, LengthDomain=number_slider_7)  # -> simplify(flatten(TrimmedVector))
move_5 = Move(Geometry=pt_5, Motion=trmvec_2)  # -> simplify(flatten(Geometry)), Transform

merge_2 = Merge(Data1=simplify(flatten(move_3.Geometry)), Data2=simplify(move_5.Geometry), Data3=trmvec_2, Data4=trmvec)  # -> flatten(Result)
group_2 = Group(Objects=merge_2)

loop_end = LoopEnd(port=loop_start.port, Exit=False, Data=group_2, pausedState=False, state="Constant output", TimeOutVal=0)
ungroup_2 = Ungroup(Group=loop_end)
item_4 = ListItem(List=ungroup_2, Index=Slider(17, range=0..100), Wrap=True)
sph = Sphere(Base=item_4, Radius=Slider(7, range=0..10))
subset = SubList(List=ungroup_2, Domain=dom, Wrap=True)  # -> List, Index
mesh_uv = MeshSurface(Surface=sph, UCount=number_slider_3, VCount=number_slider_3, Overhang=True, Equalize=False)
sph_2 = Sphere(Base=subset.List, Radius=Slider(7, range=0..10))
mesh_uv_2 = MeshSurface(Surface=sph_2, UCount=number_slider_4, VCount=number_slider_4, Overhang=True, Equalize=False)
mcol = MeshColours(Mesh=mesh_uv, Colours=ColourSwatch(SwatchColor=RGB(255, 255, 255)))
mcol_2 = MeshColours(Mesh=mesh_uv_2, Colours=ColourSwatch(SwatchColor=RGB(162, 0, 42)))

# ==== cluster Steer
maxf = ClusterInput()
vel = ClusterInput()
maxv = ClusterInput()
des = ClusterInput()
amp = Amplitude(Vector=des, Amplitude=maxv)
subtraction = Subtraction(A=amp, B=vel)
multiplication = Multiplication(A=subtraction, B=maxf)
vlen = VectorLength(Vector=multiplication)
min = Minimum(A=vlen, B=maxv)
amp_2 = Amplitude(Vector=multiplication, Amplitude=min)
acc = ClusterOutput(amp_2)
