# Grasshopper definition Agent seminar submission - Jonathan Irawan and Peter Magnus.gh (Grasshopper 0.9.76)
# plug-ins: Anemone, Boid, Noise 4D

# ---- group: color mesh
crv = Curve(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)
srf = Surface(crv)
mesh_uv = MeshSurface(Surface=srf, UCount=Slider(50, range=0..100), VCount=Slider(29, range=0..100), Overhang=True, Equalize=False)
demesh = DeconstructMesh(Mesh=mesh_uv)  # -> Vertices, Faces, Colours, Normals
perlin = PerlinNoise(Values=demesh.Vertices, Time=Slider(47, range=0..100), Scale=Slider(0.025, range=0..0.1))
gradient = Gradient(LowerLimit=-1, UpperLimit=1, Parameter=perlin, stops=[0: RGB(255, 255, 255), 1: RGB(0, 0, 0)])
conmesh = ConstructMesh(Vertices=demesh.Vertices, Faces=demesh.Faces, Colours=gradient)

# ---- group: agents
number_slider = Slider(0.2, range=0..1)
number_slider_2 = Slider(80, range=0..100)
popgeo = PopulateGeometry(Geometry=conmesh, Count=number_slider_2, Seed=Slider(5, range=0..100))
vec = VectorXYZ(XComponent=number_slider, YComponent=number_slider, ZComponent=0)  # -> Vector, Length
lng = ListLength(List=popgeo)
repeat = RepeatData(Data=vec.Vector, Length=lng)

# ----
merge = Merge(Data1=simplify(graft(popgeo)), Data2=simplify(graft(repeat)), Data3=simplify(graft(popgeo)))
rndvec = RandomVector(Number=lng, Unit=False, RandomSeed=2, AbsoluteMultiplier=1)
demesh_2 = DeconstructMesh(Mesh=conmesh)  # -> Vertices, Faces, Colours, Normals
group = Group(Objects=merge)

loop_start = LoopStart(N=Slider(200, range=0..250), T=Button(), D0=group, D1=demesh_2.Colours)  # -> port, Counter, Data, Data_2
panel = Panel(loop_start.Counter)

# ---- group: Stop loop?
toggle = BooleanToggle(True)

# ----
ungroup = Ungroup(Group=loop_start.Data)
split = SplitList(List=ungroup, Index="2")  # -> ListA, ListB
item = ListItem(List=split.ListA, Index=0, Wrap=True)  # -> Item, Item1

vec_2 = Vector(item.Item1)

# ---- group: point location
pt = Point(flatten(item.Item))

# ----
cps = ClosestPoints(Point=pt, Cloud=demesh_2.Vertices, Count=Slider(2, range=0..10))  # -> ClosestPoint, CPIndex, Distance
vdis = VectorDisplay(Anchor=pt, Vector=vec_2)

cluster = Cluster(L=demesh_2.Vertices)
visible = FindVisibleAgents(
    AgentLocationPoint=pt,
    AgentMotionVector=flatten(vec_2),
    LocationPointsOfTheFlock=demesh_2.Vertices,
    FlockMotionVectors=cluster,
    SearchDistance=Slider(18, range=0..150),
    SearchAngle=Slider(0.8, range=0..1))  # -> ListOfPoints, ListOfVectors, simplify(ListOfIndices)

crv_2 = Curve(crv)

border_threshold = Slider(3.424, range=0..100)
offset = Offset(Curve=crv_2, Distance=expr("-x", border_threshold), Plane=PlaneXY(0, 0, 0), Corners=1)
preview = CustomPreview(
    Geometry=offset,
    Shader={ambient=RGB(0, 0, 0), diffuse=RGB(255, 105, 180), emission=RGB(76, 32, 54), shine=0.5, specular=RGB(255, 255, 255), transparency=0})

num = Number(number_slider_2)

multiplication = Multiplication(A=vec_2, B=Slider(0.05, range=0..0.1))

lng_2 = ListLength(List=pt)
repeat_2 = RepeatData(Data=ColourSwatch(SwatchColor=RGB(74, 255, 164)), Length=lng_2)
cloud = CloudDisplay(Points=pt, Colours=repeat_2, Size=Slider(0.4, range=0..12), SpriteType=1)

# ---- group: show tail
pt_2 = Point(split.ListB)
cluster_2 = Cluster_2(L=pt_2)
# 15-17 April 2016
cloud_2 = CloudDisplay(Points=simplify(pt_2), Colours=cluster_2, Size=Slider(0.5, range=0..12), SpriteType=1)

# ----
cp = ClosestPoint(Point=pt, Cloud=demesh_2.Vertices)  # -> ClosestPoint, CPIndex, Distance
ph_strength = Slider(0.128, range=0..1)
item_2 = ListItem(List=loop_start.Data_2, Index=cps.CPIndex, Wrap=True)  # -> simplify(Item1), Item
ahsv = SplitAHSV(Colour=item_2.Item1)  # -> Alpha, Hue, Saturation, Value
addition = Addition(A=ahsv.Value, B=ph_strength)

subtraction = Subtraction(A=ahsv.Value, B=ph_strength)

min = Minimum(A=subtraction, B="1")
frgb = ColourRGBF(Alpha=1, Red=min, Green=min, Blue=min)
replace = ReplaceItems(List=flatten(loop_start.Data_2), Item=flatten(frgb), Indices=flatten(cps.CPIndex), Wrap=False)
multiplication_2 = Multiplication(A=replace, B="1")

pt_3 = Point(pt)
data = Data(visible.ListOfIndices)
num_2 = Number(Slider(1, range=0..1))
num_3 = Number(Slider(1, range=0..1))
col = Colour(loop_start.Data_2)

item_3 = ListItem(List=col, Index=data, Wrap=True)  # -> simplify(Item)
item_4 = ListItem(List=demesh_2.Vertices, Index=data, Wrap=True)
argb = SplitARGB(Colour=item_3)  # -> Alpha, Red, Green, Blue
sort = SortList(Keys=argb.Red, ValuesA=item_4)  # -> Keys, ValuesA
item_5 = ListItem(List=sort.ValuesA, Index=0, Wrap=True)  # -> Item1, Item

panel_2 = Panel(sort.Keys)

# ---- group: BORDER CONDITION
crv_cp = CurveClosestPoint(Point=pt, Curve=crv_2)  # -> Point, Parameter, Distance
eval = EvaluateCurve(Curve=crv_2, Parameter=crv_cp.Parameter)  # -> Point, Tangent, Angle
smaller = SmallerThan(FirstNumber=crv_cp.Distance, SecondNumber=border_threshold)  # -> SmallerThan, OrEqualTo
vec2pt = Vector2Pt(PointA=eval.Point, PointB=pt, Unitize=False)  # -> Vector, Length
dispatch = Dispatch(List=vec2pt.Vector, DispatchPattern=smaller.SmallerThan)  # -> ListA, ListB
easing = Slider(0.413, range=0..1)
vlen = VectorLength(Vector=dispatch.ListA)
subtraction_2 = Subtraction(A=border_threshold, B=vlen)
multiplication_3 = Multiplication(A=subtraction_2, B=easing)
amp = Amplitude(Vector=dispatch.ListA, Amplitude=multiplication_3)
pt_4 = Point(Point(0, 0, 0))

# ----
lng_3 = ListLength(List=dispatch.ListA)
subtraction_3 = Subtraction(A=num, B=lng_3)
dup = DuplicateData(Data=pt_4, Number=subtraction_3, Order=True)

# ---- group: BORDER CONDITION (continued)
weave = Weave(Pattern=smaller.SmallerThan, Stream0=dup, Stream1=amp, NullGaps=False)

# ----
vec_3 = Vector(weave)

item_6 = ListItem(List=sort.Keys, Index=0, Wrap=True)  # -> Item1, Item
vec2pt_2 = Vector2Pt(PointA=simplify(graft(pt_3)), PointB=simplify(item_5.Item1), Unitize=True)  # -> flatten(Vector), Length
larger = LargerThan(FirstNumber=item_6.Item1, SecondNumber=num_2)  # -> flatten(LargerThan), OrEqualTo
amp_2 = Amplitude(Vector=vec2pt_2.Vector, Amplitude=num_3)

vec_4 = VectorXYZ(XComponent="0", YComponent="0", ZComponent="0")  # -> Vector, Length
lng_4 = ListLength(List=amp_2)
repeat_3 = RepeatData(Data=vec_4.Vector, Length=lng_4)

p_n_c = PickNChoose(Pattern=larger.LargerThan, Stream0=amp_2, Stream1=repeat_3)  # -> simplify(graft(Result))

addition_2 = Addition(A=p_n_c, B=simplify(multiplication), C=simplify(graft(vec_3)))  # -> flatten(Result)
move = Move(Geometry=pt, Motion=addition_2)  # -> Geometry, Transform
vec_5 = Vector(addition_2)
pt_5 = Point(move.Geometry)
pt_6 = Point(split.ListB)
tlist = TailList(L=pt_6, it=simplify(graft(move.Geometry)), len=Slider(30, range=0..100))  # -> out, simplify(A); inputs L: list, len: Int32
# ---------- tlist: C# ----------
    Component.Name = "Tail List";
    Component.NickName = "TList";
    Component.Description = "Tail list - L list, it item to add, len tail length";

    if (L.Count() > len) {
      L.RemoveAt(0);
    }
    L.Add(it);
    A = L;
# ---------- end tlist ----------
merge_2 = Merge(Data1=simplify(graft(pt_5)), Data2=simplify(graft(vec_5)), Data3=simplify(tlist.A))
group_2 = Group(Objects=merge_2)
loop_end = LoopEnd(
    port=loop_start.port,
    Exit=toggle,
    Data=group_2,
    Data_2=multiplication_2,
    pausedState=False,
    state="Constant output",
    TimeOutVal=0)  # -> D0, D1

ungroup_2 = Ungroup(Group=loop_end.D0)
conmesh_2 = ConstructMesh(Vertices=demesh_2.Vertices, Faces=demesh_2.Faces, Colours=loop_end.D1)
split_2 = SplitList(List=ungroup_2, Index="3")  # -> ListA, ListB

# ----
# noise map
interval = Slider(2, range=1..10)
repeat_4 = RepeatData(Data="0", Length=expr("x-1", interval))
merge_3 = Merge(Data1="1", Data2=repeat_4)  # -> flatten(Result)
cull = CullPattern(List=split_2.ListB, CullPattern=merge_3)
# vel
# col
# trail
number_slider_3 = Slider(8, range=1..30)
pline = PolyLine(Vertices=cull, Closed=False)
smoothpline = SmoothPolyline(Polyline=pline, Strength=1, Times=number_slider_3)
# basic parameters
# read environment
# future location
number_slider_4 = Slider(1, range=1..3)

item_7 = ListItem(List=split_2.ListA, Index=0, Wrap=True)  # -> Item, Item1, Item2
addition_3 = Addition(A=Slider(0.596, range=0..3), B=1)
cloud_3 = CloudDisplay(Points=item_7.Item, Colours=item_7.Item2, Size=addition_3, SpriteType=0)

# ----
# loc
# vel
# col
# add to trail
# steer
# write to environment
# brightest
# darkest
preview_2 = CustomPreview(Geometry=smoothpline, Shader=ColourSwatch(SwatchColor=RGB(113, 162, 189)))

# ==== cluster Cluster
L = ClusterInput()
vec = VectorXYZ(XComponent="0", YComponent="0", ZComponent="0")  # -> Vector, Length
lng = ListLength(List=L)
repeat = RepeatData(Data=vec.Vector, Length=lng)
D = ClusterOutput(repeat)

# ==== cluster Cluster_2
L = ClusterInput()

lng = ListLength(List=L)  # -> flatten(Length)
item = ListItem(List=lng, Index=0, Wrap=True)
round = Round(Number=item)  # -> Nearest, Floor, Ceiling
division = Division(A="1", B=round.Ceiling)
series = Series(Start=0, Step=division, Count=round.Ceiling)
graph = GraphMapper(
    series,
    x0=0,
    x1=1,
    y0=0,
    y1=1,
    container_name="Bezier",
    cpx=[0, 0.6374178529, 0.8142894506, 1],
    cpy=[0, 0.1260549426, 0.5961636305, 1])
xyz = ColourXYZ(Alpha=1, X=graph, Y=graph, Z=graph)
series_2 = Series(Start=Slider(0.1, range=0..1), Step=Slider(0.05, range=0..0.1), Count=item)

C = ClusterOutput(xyz)
