# Grasshopper definition AndresMora_&_SureshkumarKumaravel.gh (Grasshopper 0.9.76)
# plug-ins: Heteroptera, Anemone, Human, Kangaroo Components, Weaverbird, Mesh Pipe

# ----
# reciproCITY
# Alessio Erioli
# Aldo Sollazzo
# Eugenio Bettucchi
# DEFINITIONS BY
discrete_direction = Panel("BUILDING A VECTOR RANGE")

# ---- group: base point
pt = Point(<point referenced from the Rhino model>)

# ---- group: dimension
number_slider = Slider(400, range=100..400)
number_slider_2 = Slider(400, range=100..400)

# ---- group: resolution
number_slider_3 = Slider(75, range=10..169)
number_slider_4 = Slider(60, range=10..100)

# ----
panel = Panel("ambient")

# ---- group: ambient
rectangle = Rectangle(Plane=pt, XSize=number_slider, YSize=number_slider_2, Radius=0)  # -> Rectangle, Length
mplane = MeshPlane(Boundary=rectangle.Rectangle, WidthCount=number_slider_3, HeightCount=number_slider_4)  # -> Mesh, Area

# ----
# DISCRETE DIRECTION: GENERATING GRID AND AGENTS
demesh = DeconstructMesh(Mesh=mplane.Mesh)  # -> Vertices, Faces, Colours, Normals
pt_2 = Point(demesh.Vertices)

# ---- group: AGENTS GENERATION
boundary = BoundarySurfaces(Edges=rectangle.Rectangle)
edges = BrepEdges(Brep=boundary)  # -> Naked, Interior, NonManifold
item = ListItem(List=edges.Naked, Index=0, Wrap=True)  # -> Item1, Item

crv_cp = CurveClosestPoint(Point=graft(pt_2), Curve=edges.Naked)  # -> Point, Parameter, Distance
number_slider_5 = Slider(32, range=0..100)
sort = SortList(Keys=crv_cp.Distance)  # -> Keys, ValuesA

# ---- group: AGENTS GENERATION / AGENTS LOCATION
item_2 = ListItem(List=sort.Keys, Index=0, Wrap=True)  # -> flatten(Item)
smaller = SmallerThan(FirstNumber=item_2, SecondNumber=number_slider_5)  # -> SmallerThan, OrEqualTo
cull = CullPattern(List=pt_2, CullPattern=smaller.SmallerThan)
reduce = RandomReduce(List=cull, Reduction=Slider(1000, range=0..1000), Seed=1)

# ---- group: FIELD LOCATION
md_slider = MDSlider(
    slider_value=Point(0.5340995789, 0.5053024292, 0.5),
    SliderMode=0,
    x_domain=Domain(0, 1),
    y_domain=Domain(0, 1),
    z_domain=Domain(0, 1))
join = JoinCurves(Curves=edges.Naked, Preserve=False)
evalsrf = EvaluateSurface(Surface=reparameterize(join), Point=md_slider)  # -> Point, Normal, Frame

# ----
number_slider_6 = Slider(0, range=0..1000)
pt_3 = Point(<point referenced from the Rhino model>)
Z = UnitZ(Factor=Slider(20, range=0..100))
pt_4 = Point(<point referenced from the Rhino model>)
pt_5 = Point(<point referenced from the Rhino model>)
move = Move(Geometry=evalsrf.Point, Motion=Z)  # -> Geometry, Transform
number_slider_7 = Slider(252, range=0..1000)

# ---- group: SPINNING FORCE HIGHER QUOTE
cir = Circle(Plane=move.Geometry, Radius=Slider(195, range=0..300))
Z_2 = UnitZ(Factor=Slider(252, range=0..1000))
extr = Extrude(Base=cir, Direction=Z_2)
bbox = BoundingBox(Content=extr, Plane=PlaneXY(0, 0, 0))  # -> Box, Box_2
fspin = SpinForce(Plane=move.Geometry, Strength=1, Radius=Slider(49, range=0..100), Decay=Slider(1.155, range=0..4), Bounds=bbox.Box)

# ---- group: SPINNING VECTOR
cir_2 = Circle(Plane=evalsrf.Point, Radius=Slider(250, range=0..250))
Z_3 = UnitZ(Factor=Slider(16, range=0..40))
extr_2 = Extrude(Base=cir_2, Direction=Z_3)
bbox_2 = BoundingBox(Content=extr_2, Plane=PlaneXY(0, 0, 0))  # -> Box, Box_2
fspin_2 = SpinForce(Plane=evalsrf.Point, Strength=1, Radius=Slider(50, range=0..100), Decay=Slider(1.283, range=0..4), Bounds=bbox_2.Box)

# ---- group: Z axis Vector
pt_6 = Point(<point referenced from the Rhino model>)
Z_4 = UnitZ(Factor=Slider(0.35, range=0..1))
cir_3 = Circle(Plane=pt_6, Radius=Slider(241, range=0..300))
Z_5 = UnitZ(Factor=Slider(527, range=0..1000))
move_2 = Move(Geometry=evalsrf.Point, Motion=Z_4)  # -> Geometry, Transform
extr_3 = Extrude(Base=cir_3, Direction=Z_5)
ln = Line(StartPoint=evalsrf.Point, EndPoint=move_2.Geometry)
bbox_3 = BoundingBox(Content=extr_3, Plane=PlaneXY(0, 0, 0))  # -> Box, Box_2
fvector = VectorForce(Line=ln, Bounds=bbox_3.Box)

# ---- group: VERTICAL VECTOR
Z_6 = UnitZ(Factor=Slider(0.4, range=0..1))
cir_4 = Circle(Plane=pt_3, Radius=Slider(27, range=0..100))
Z_7 = UnitZ(Factor=Slider(200, range=0..1000))
move_3 = Move(Geometry=evalsrf.Point, Motion=Z_6)  # -> Geometry, Transform
extr_4 = Extrude(Base=cir_4, Direction=Z_7)
ln_2 = Line(StartPoint=evalsrf.Point, EndPoint=move_3.Geometry)
bbox_4 = BoundingBox(Content=extr_4, Plane=PlaneXY(0, 0, 0))  # -> Box, Box_2
fvector_2 = VectorForce(Line=ln_2, Bounds=bbox_4.Box)

# ---- group: ATTRACTOR VECTOR
neg = Negative(Value=Slider(1, range=0..1))
pcharge = PointCharge(Point=pt_3, Charge=neg, Decay=Slider(0.68, range=0..1), Bounds=bbox_2.Box)

# ----
# 15-17 April 2016
number_slider_8 = Slider(2, range=0..10)
number_slider_9 = Slider(5, range=0..5)
sqgrid = Square(Plane=PlaneXY(0, 0, 0), Size=number_slider_9, ExtentX=number_slider_8, ExtentY=number_slider_8)  # -> Cells, flatten(Points)
avr = Average(Input=sqgrid.Points)
explode = Explode(Curve=sqgrid.Cells, Recursive=True)  # -> Segments, flatten(Vertices)
series = Series(Start=0, Step=number_slider_9, Count=Slider(3, range=0..10))
cullpt = CullDuplicates(Points=explode.Vertices, Tolerance=0.1, CullMode=3)  # -> Points, Indices, Valence
Z_8 = UnitZ(Factor=series)
move_4 = Move(Geometry=cullpt.Points, Motion=graft(Z_8))  # -> flatten(Geometry), Transform
avr_2 = Average(Input=move_4.Geometry)
ln_3 = Line(StartPoint=avr_2, EndPoint=move_4.Geometry)
dupln = RemoveDuplicateLines(Lines=ln_3, Tolerance=0.01)
len = Length(Curve=dupln)
toggle = BooleanToggle(False)
sort_2 = SortList(Keys=len, ValuesA=dupln)  # -> Keys, ValuesA
shift = ShiftList(List=sort_2.ValuesA, Shift=1, Wrap=toggle)

shift_2 = ShiftList(List=sort_2.Keys, Shift=1, Wrap=toggle)

amp = Amplitude(Vector=shift, Amplitude=shift_2)
line = LineSDL(Start=avr_2, Direction=amp, Length=shift_2)
group = Group(Objects=line)

col = Colour(flatten([RGB(11, 196, 239), RGB(2, 61, 71), RGB(7, 92, 109), RGB(8, 179, 228), RGB(0, 30, 48), RGB(2, 135, 246), RGB(2, 49, 80), RGB(1, 32, 46), RGB(4, 80, 155), RGB(3, 107, 151)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]))
pt_7 = Point(reduce)
pt_8 = Point(pt_7)

lng = ListLength(List=pt_7)
rnd_vector = RandomVector(Number=lng, Lenght="1.3", isflat=True)

vec = Vector(flatten(rnd_vector))

merge = Merge(Data1=simplify(graft(pt_7)), Data2=simplify(graft(vec)), Data3=simplify(graft(col)))

group_2 = Group(Objects=merge)

loop_start = LoopStart(Repeat=number_slider_6, Trigger=Button(), Data=group_2)  # -> port, Counter, Data
panel_2 = Panel(loop_start.Counter)

ungroup = Ungroup(Group=loop_start.Data)  # -> simplify(Objects)
split = SplitList(List=ungroup, Index="3")  # -> ListA, ListB
list_item = ListItem(List=split.ListA, Index=0, Wrap=True)  # -> Item, Item1, Item2

# ---- group: DISCRETIZATION APPLIED TO ALL AGENTS
vec2pt = Vector2Pt(PointA=avr_2, PointB=flatten(list_item.Item), Unitize=False)  # -> Vector, Length
move_5 = Move(Geometry=group, Motion=graft(vec2pt.Vector))  # -> simplify(Geometry), Transform
ungroup_2 = Ungroup(Group=move_5.Geometry)  # -> simplify(Objects)
len_2 = Length(Curve=ungroup_2)
amp_2 = Amplitude(Vector=ungroup_2, Amplitude=len_2)

# ----
item_3 = ListItem(List=amp_2, Index=Slider(28, range=0..30), Wrap=True)  # -> flatten(Item)

# ---- group: VERTICAL VECTOR
boxprop = BoxProperties(Box=bbox.Box)  # -> Center, Diagonal, Area, Volume, Degeneracy; disabled
pt_9 = Point(list_item.Item)  # disabled
pdecon = Deconstruct(Point=pt_9)  # -> XComponent, YComponent, flatten(ZComponent); disabled
pdecon_2 = Deconstruct(Point=boxprop.Center)  # -> XComponent, YComponent, ZComponent; disabled
smaller_2 = SmallerThan(FirstNumber=pdecon.ZComponent, SecondNumber=pdecon_2.ZComponent)  # -> SmallerThan, OrEqualTo; disabled

# ----
vdisex = VectorDisplayEx(Point=flatten(list_item.Item), Vector=item_3, Colour=RGB(0, 0, 0), Width=2)
equals = Equality(FirstNumber=loop_start.Counter, SecondNumber=number_slider_6)  # -> Equality, Inequality

# ---- group: -Z axis VECTOR
number_slider_10 = Slider(0.35, range=0..1)
number_slider_11 = Slider(100, range=0..100)
cir_5 = Circle(Plane=pt_5, Radius=Slider(100, range=0..100))
Z_9 = UnitZ(Factor=number_slider_7)
extr_5 = Extrude(Base=cir_5, Direction=Z_9)
bbox_5 = BoundingBox(Content=extr_5, Plane=PlaneXY(0, 0, 0))  # -> Box, Box_2

# ----
Z_10 = UnitZ(Factor=number_slider_10)
neg_2 = Negative(Value=Z_10)

# ---- group: -Z axis VECTOR (continued)
move_6 = Move(Geometry=evalsrf.Point, Motion=neg_2)  # -> Geometry, Transform
ln_4 = Line(StartPoint=evalsrf.Point, EndPoint=move_6.Geometry)
fvector_3 = VectorForce(Line=ln_4, Bounds=bbox_5.Box)

# ---- group: Y axis VECTOR
number_slider_12 = Slider(100, range=0..100)
number_slider_13 = Slider(0.35, range=0..1)
cir_6 = Circle(Plane=pt_4, Radius=number_slider_7)
Z_11 = UnitZ(Factor=Slider(52, range=0..100))
extr_6 = Extrude(Base=cir_6, Direction=Z_11)
bbox_6 = BoundingBox(Content=extr_6, Plane=PlaneXY(0, 0, 0))  # -> Box, Box_2

# ----
Y = UnitY(Factor=number_slider_13)

# ---- group: Y axis VECTOR (continued)
move_7 = Move(Geometry=evalsrf.Point, Motion=Y)  # -> Geometry, Transform
ln_5 = Line(StartPoint=evalsrf.Point, EndPoint=move_7.Geometry)
fvector_4 = VectorForce(Line=ln_5, Bounds=bbox_6.Box)

# ---- group: MERGE VECTOR FIELDS
mergef = MergeFields(Fields=flatten([pcharge, fvector_2, fspin_2, fvector_3, fvector_4, fspin, fvector]))
pt_10 = Point(simplify(list_item.Item))
evf = EvaluateField(Field=mergef, Point=simplify(pt_10))  # -> Tensor, Strength

# ----
addition = Addition(A=evf.Tensor)

# ---- group: DISCRETIZATION APPLIED TO ALL AGENTS
angle = Angle(VectorA=addition, VectorB=amp_2)  # -> Angle, Reflex
sort_3 = SortList(Keys=simplify(angle.Angle), ValuesA=amp_2)  # -> Keys, ValuesA
item_4 = ListItem(List=sort_3.ValuesA, Index=0, Wrap=True)  # -> simplify(Item)

# ----
move_8 = Move(Geometry=list_item.Item, Motion=item_4)  # -> Geometry, Transform
merge_2 = Merge(Data1=simplify(move_8.Geometry), Data2=simplify(addition), Data3=simplify(list_item.Item2))
group_3 = Group(Objects=merge_2)

# ---- group: VERTICAL VECTOR / VECTOR REPLACING CONDITION
p_n_c = PickNChoose(Pattern=smaller_2.SmallerThan, Stream0=flatten(item_3), Stream1=flatten(item_4))  # -> simplify(graft(Result)); disabled

# ----
loop_end = LoopEnd(port=loop_start.port, Exit=False, Data=group_3, pausedState=False, state="Constant & Record", TimeOutVal=0)

# ---- group: GENERATING TRAIL FROM RECORDED HISTORY
pshift = ShiftPaths(Data=loop_end, Offset=-1)
ungroup_3 = Ungroup(Group=pshift)  # -> simplify(Objects)
item_5 = ListItem(List=ungroup_3, Index=0, Wrap=True)
pshift_2 = ShiftPaths(Data=item_5, Offset=-1)
flip = FlipMatrix(Data=pshift_2)
pline = PolyLine(Vertices=flip, Closed=False)

# ----
gate = StreamGate(Stream=pline, Gate=equals.Equality)  # -> Target0, Target1
preview = CustomPreview(Geometry=gate.Target0, Shader=ColourSwatch(SwatchColor=RGB(46, 170, 219)))

# ---- group: MESHING TRAIL
mpipe = MeshPipe(
    Curve=gate.Target1,
    Radius=Slider(2, range=0..2.5),
    Accuracy=0.2,
    Rotation=0,
    Segments=Slider(3, range=0..10),
    Caps=Slider(1, range=0..1))

# ---- group: MESHING TRAIL / CLEAN MESH
mjoin = MeshJoin(Meshes=mpipe)
wbjoin = WeaverbirdsJoinMeshesAndWeld(Mesh=mjoin, Weld=False)

# ---- group: COLOR THE LINE ACCORDING TO OVERLAPPING SEGMENTS
explode_2 = Explode(Curve=gate.Target1, Recursive=True)  # -> flatten(Segments), Vertices
curvepoint = PointOnCurve(explode_2.Segments, parameter=0.5)
cullpt_2 = CullDuplicates(Points=flatten(curvepoint), Tolerance=Slider(0.01, range=0..0.01), CullMode=1)  # -> Points, Indices, Valence
item_6 = ListItem(List=explode_2.Segments, Index=cullpt_2.Indices, Wrap=True)
bnd = Bounds(Numbers=cullpt_2.Valence)
dedomain = DeconstructDomain(Domain=bnd)  # -> Start, End
gradient = Gradient(
    LowerLimit=0,
    UpperLimit=dedomain.End,
    Parameter=cullpt_2.Valence,
    stops=[0: RGB(64, 64, 64), 0.155: RGB(120, 120, 120), 0.25: RGB(128, 128, 128), 0.802: RGB(255, 255, 255)])
number_slider_14 = Slider(3, range=0..10)
swatch = ColourSwatch(SwatchColor=RGB(255, 255, 255))

# ----
dom = ConstructDomain(DomainStart=Slider(1, range=0..2), DomainEnd=Slider(4, range=0..100))
remap = RemapNumbers(Value=cullpt_2.Valence, Source=bnd, Target=dom)  # -> Mapped, Clipped

# ---- group: COLOR THE LINE ACCORDING TO OVERLAPPING SEGMENTS (continued)
previewlw = CustomPreviewLineweights(Geometry=item_6, Shader=gradient, Thickness=remap.Mapped)
