# Grasshopper definition Def 1.gh (Grasshopper 0.9.76)
# Copyright: Co-de-iT
# plug-ins: Anemone, Boid

R = Region({Plane=PlaneXY(0, 0, 0), X=Domain(0, 63.89154561), Y=Domain(0, 63.89154561), Z=Domain(0, 12.77830912)})

# ----
# Start
number_slider = Slider(252.187, range=1..501)
pop3d = Populate3D(Region=R, Count=number_slider, Seed=1)
pt = Point(pop3d)

# ----
# generated pred
Z = UnitZ(Factor=1)
lng = ListLength(List=pt)
repeat = RepeatData(Data=Z, Length=lng)

# ----
# generated targets
item = ListItem(List=pop3d, Index=0, Wrap=True)  # -> Item, Item1, Item2
pt_2 = Point([item.Item, item.Item1, item.Item2])

lng_2 = ListLength(List=pt_2)
rndvec = RandomVector(Number=lng_2, Unit=False, RandomSeed=Slider(50, range=0..100), AbsoluteMultiplier=1)

loop_start = LoopStart(Repeat=Slider(0, range=0..1000), Trigger=Button(), Data_0=pt, Data_1=repeat, Data_2=pt_2, Data_3=rndvec)  # -> port, Counter, Data_0, Data_1, Data_2, Data_3

# ----
# Targets
pt_3 = Point(loop_start.Data_2)
vec = Vector(loop_start.Data_3)

# ----
# Predators
pt_4 = Point(loop_start.Data_0)
vec_2 = Vector(loop_start.Data_1)

# ----
# closest point D
# Acting upon
number_slider_2 = Slider(1, range=0..100)
cp = ClosestPoint(Point=pt_3, Cloud=pt_4)  # -> simplify(graft(ClosestPoint)), CPIndex, Distance
maxv = Slider(4.39, range=0..5)
maxv_2 = Slider(1.12, range=0..5)
smaller = SmallerThan(FirstNumber=cp.Distance, SecondNumber=number_slider_2)  # -> SmallerThan, OrEqualTo
repeat_2 = RepeatData(Data=maxv_2, Length=lng_2)
repeat_3 = RepeatData(Data=maxv, Length=lng_2)
panel = Panel(smaller.SmallerThan)
p_n_c = PickNChoose(Pattern=smaller.SmallerThan, Stream0=repeat_2, Stream1=repeat_3)
panel_2 = Panel(p_n_c)

# ----
# randomness
rndvec_2 = RandomVector(Number=lng_2, Unit=False, RandomSeed=loop_start.Counter, AbsoluteMultiplier=1)
vdisex = VectorDisplayEx(Point=pt_3, Vector=rndvec_2, Colour=RGB(0, 0, 0), Width=2)

maxv_3 = Slider(4.39, range=0..5)
maxf = Slider(0.074, range=0..1)

cps = ClosestPoints(Point=pt_4, Cloud=pt_3, Count=Slider(1, range=0..4))  # -> ClosestPoint, CPIndex, Distance
avr = Average(Input=cps.ClosestPoint)  # -> flatten(ArithmeticMean)
vec2pt = Vector2Pt(PointA=pt_4, PointB=avr, Unitize=False)  # -> Vector, Length
steer = Steer(vel=vec_2, des=vec2pt.Vector, maxv=maxv_3, maxf=maxf)

multiplication = Multiplication(A=Slider(1, range=0..1), B=vec_2)

# ----
# steering
# A
# V
# D*
# F
number_slider_3 = Slider(0.245, range=0..1)
number_slider_4 = Slider(5, range=0..5)
steer_2 = Steer(vel=graft(vec), des=graft(rndvec_2), maxv=graft(p_n_c), maxf=number_slider_3)  # -> flatten(acc)

trmvec = TrimVector(Vector=steer, LengthDomain=Slider(3.6, range=0..5))

number_slider_5 = Slider(0.245, range=0..1)

panel_3 = Panel(steer_2)

# ----
# //Triangle generation
# //bounding Areas
item_2 = ListItem(List=flatten(cp.ClosestPoint), Index=0, Wrap=True)  # -> Item, Item1, Item2; disabled
pt_5 = Point(item_2.Item)  # disabled
pt_6 = Point(item_2.Item1)  # disabled
pt_7 = Point(item_2.Item2)  # disabled
hull = ConvexHull(Points=[pt_5, pt_6, pt_7], Plane=PlaneXY(0, 0, 0))  # -> Hull, HullZ, Indices; disabled
area = Area(Geometry=hull.HullZ)  # -> Area, Centroid; disabled
area_2 = Area(Geometry=hull.HullZ)  # -> Area, Centroid; disabled
panel_4 = Panel(area_2.Area)  # disabled
panel_5 = Panel(pt_5)  # disabled
boundary = BoundarySurfaces(Edges=hull.HullZ)  # disabled
boundary_2 = BoundarySurfaces(Edges=hull.HullZ)  # disabled
boundary_3 = BoundarySurfaces(Edges=hull.HullZ)  # disabled
boundary_4 = BoundarySurfaces(Edges=hull.HullZ)  # disabled
area_3 = Area(Geometry=boundary)  # -> Area, Centroid; disabled
area_4 = Area(Geometry=boundary_2)  # -> Area, Centroid; disabled
area_5 = Area(Geometry=boundary_3)  # -> Area, Centroid; disabled
area_6 = Area(Geometry=boundary_4)  # -> Area, Centroid; disabled
number_slider_6 = Slider(1300, range=0..10000)  # disabled
number_slider_7 = Slider(1200, range=0..10000)  # disabled
number_slider_8 = Slider(1400, range=0..10000)  # disabled
number_slider_9 = Slider(2000, range=0..10000)  # disabled
number_slider_10 = Slider(1900, range=0..10000)  # disabled
number_slider_11 = Slider(3100, range=0..10000)  # disabled
number_slider_12 = Slider(1480, range=0..10000)  # disabled
number_slider_13 = Slider(3000, range=0..10000)  # disabled
smaller_2 = SmallerThan(FirstNumber=area_3.Area, SecondNumber=number_slider_6)  # -> SmallerThan, OrEqualTo; disabled
larger = LargerThan(FirstNumber=area_3.Area, SecondNumber=number_slider_7)  # -> LargerThan, OrEqualTo; disabled
smaller_3 = SmallerThan(FirstNumber=area_4.Area, SecondNumber=number_slider_12)  # -> SmallerThan, OrEqualTo; disabled
larger_2 = LargerThan(FirstNumber=area_4.Area, SecondNumber=number_slider_8)  # -> LargerThan, OrEqualTo; disabled
smaller_4 = SmallerThan(FirstNumber=area_5.Area, SecondNumber=number_slider_9)  # -> SmallerThan, OrEqualTo; disabled
larger_3 = LargerThan(FirstNumber=area_5.Area, SecondNumber=number_slider_10)  # -> LargerThan, OrEqualTo; disabled
smaller_5 = SmallerThan(FirstNumber=area_6.Area, SecondNumber=number_slider_11)  # -> SmallerThan, OrEqualTo; disabled
larger_4 = LargerThan(FirstNumber=area_6.Area, SecondNumber=number_slider_13)  # -> LargerThan, OrEqualTo; disabled
panel_6 = Panel(larger_3.LargerThan)  # disabled
panel_7 = Panel(smaller_5.SmallerThan)  # disabled
panel_8 = Panel(larger_4.LargerThan)  # disabled
panel_9 = Panel(smaller_2.SmallerThan)  # disabled
panel_10 = Panel(larger.LargerThan)  # disabled
panel_11 = Panel(smaller_3.SmallerThan)  # disabled
panel_12 = Panel(larger_2.LargerThan)  # disabled
panel_13 = Panel(smaller_4.SmallerThan)  # disabled
and = GateAnd(A=smaller_2.SmallerThan, B=larger.LargerThan)  # disabled
and_2 = GateAnd(A=smaller_3.SmallerThan, B=larger_2.LargerThan)  # disabled
and_3 = GateAnd(A=smaller_4.SmallerThan, B=larger_3.LargerThan)  # disabled
and_4 = GateAnd(A=smaller_5.SmallerThan, B=larger_4.LargerThan)  # disabled
or = GateOr(A=and, B=and_2, C=and_3, D=and_4)  # disabled

panel_14 = Panel(area.Area)
amp = Amplitude(Vector=rndvec_2, Amplitude=Slider(5, range=0..5))
addition = Addition(A=multiplication, B=trmvec)
move = Move(Geometry=pt_4, Motion=addition)  # -> Geometry, Transform
move_2 = Move(Geometry=pt_3, Motion=steer_2)  # -> Geometry, Transform
move_3 = Move(Geometry=pt_3, Motion=vec)  # -> Geometry, Transform

# ---- group: STEER LOGIC
vdisex_2 = VectorDisplayEx(Point=pt_3, Vector=rndvec_2, Colour=ColourSwatch(SwatchColor=RGB(176, 176, 176)), Width=Slider(1, range=0..1))
vdisex_3 = VectorDisplayEx(Point=pt_3, Vector=vec, Colour=ColourSwatch(SwatchColor=RGB(47, 157, 196)), Width=2)
vdisex_4 = VectorDisplayEx(Point=pt_3, Vector=amp, Colour=ColourSwatch(SwatchColor=RGB(255, 255, 255)), Width=2)
vdisex_5 = VectorDisplayEx(Point=move_3.Geometry, Vector=steer_2, Colour=ColourSwatch(SwatchColor=RGB(255, 0, 0)), Width=2)

# ----
loop_end = LoopEnd(
    port=loop_start.port,
    Exit=False,
    Data_0=flatten(move.Geometry),
    Data_1=flatten(trmvec),
    Data_2=flatten(move_2.Geometry),
    Data_3=flatten(steer_2),
    pausedState=False,
    state="Constant & Record")  # -> Data_0, Data_1, Data_2, Data_3
flip = FlipMatrix(Data=loop_end.Data_0)
viewer = ParamViewer(loop_end.Data_0)
pline = PolyLine(Vertices=flip, Closed=False)
cull = CullPattern(List=hull.HullZ, CullPattern=or)
rec = DataRecorder(cull, DataLimit=-10, RecordData=True)
crv = Curve(rec)
panel_15 = Panel(crv)
viewer_2 = ParamViewer(flip)
preview = CustomPreview(Geometry=loop_end.Data_2, Shader=ColourSwatch(SwatchColor=RGB(117, 117, 117)))
preview_2 = CustomPreview(Geometry=pline, Shader=ColourSwatch(SwatchColor=RGB(0, 221, 255)))

# ==== cluster Steer
maxf = ClusterInput()
vel = ClusterInput()
maxv = ClusterInput()
des = ClusterInput()
amp = Amplitude(Vector=des, Amplitude=maxv)
subtraction = Subtraction(A=amp, B=vel)
multiplication = Multiplication(A=subtraction, B=maxf)
vlen = VectorLength(Vector=multiplication)
min = Minimum(A=vlen, B=maxv)
amp_2 = Amplitude(Vector=multiplication, Amplitude=min)
acc = ClusterOutput(amp_2)
