# Grasshopper definition final mo mich.gh (Grasshopper 0.9.76)
# Copyright: Co-de-iT
# plug-ins: Anemone, Boid

pt = ConstructPoint(XCoordinate=Slider(30, range=0..30), YCoordinate=Slider(30, range=0..30), ZCoordinate=0)
pt_2 = ConstructPoint(XCoordinate=Slider(0, range=0..30), YCoordinate=Slider(0, range=0..30), ZCoordinate=0)
rec_2pt = Rectangle2Pt(Plane=PlaneXY(0, 0, 0), PointA=pt, PointB=pt_2, Radius=0)  # -> Rectangle, Length

# ---- group: goal points moving vector
vec = VectorXYZ(XComponent=Slider(0, range=0..1000), YComponent=Slider(0, range=0..1000), ZComponent=Slider(175, range=0..1000))  # -> Vector, Length

# ----
number_slider = Slider(10, range=0..10)

pop2d = Populate2D(Region=rec_2pt.Rectangle, Count=Slider(15, range=0..100), Seed=1)

pt_3 = ConstructPoint(XCoordinate=Slider(30, range=0..30), YCoordinate=Slider(30, range=0..30), ZCoordinate=0)
pt_4 = ConstructPoint(XCoordinate=Slider(0, range=0..30), YCoordinate=Slider(0, range=0..30), ZCoordinate=0)
rec_2pt_2 = Rectangle2Pt(Plane=PlaneXY(0, 0, 0), PointA=pt_3, PointB=pt_4, Radius=0)  # -> Rectangle, Length
offset = Offset(Curve=rec_2pt_2.Rectangle, Distance=Slider(71, range=0..100), Plane=PlaneXY(0, 0, 0), Corners=1)
move = Move(Geometry=offset, Motion=vec.Vector)  # -> simplify(flatten(Geometry)), Transform

crv = Curve(move.Geometry)
neg = Negative(Value=number_slider)
Y = UnitY(Factor=Slider(20, range=0..20))

# ---- group: agents that will move to reach the target points
pt_5 = Point(pop2d)

# ----
# so in order to assign to each point a vector of movement that will be redirected later to reach the goal we will retrieve first the length of the point list so we can assign to each point a vector , and then using the component repeat data we repeated the z unit as much as the list length to assign to each point a Z coordinate which will be later separated as the vector of direction of every agent point , All the point will have a voctor in the same direct with the same value that we mention using the number slider
number_slider_2 = Slider(10, range=0..10)
lng = ListLength(List=pt_5)
Z = UnitZ(Factor=number_slider_2)
panel = Panel(lng)
repeat = RepeatData(Data=Z, Length=lng)
panel_2 = Panel(Z)

preview = CustomPreview(Geometry=crv, Shader=ColourSwatch(SwatchColor=RGB(0, 0, 0)))
offset_2 = Offset(Curve=crv, Distance=neg, Plane=PlaneXY(0, 0, 0), Corners=1)
preview_2 = CustomPreview(
    Geometry=offset_2,
    Shader={ambient=RGB(0, 0, 0), diffuse=RGB(255, 105, 180), emission=RGB(76, 32, 54), shine=0.5, specular=RGB(255, 255, 255), transparency=0})

# ----
# here we first grafted each list and simplified it before it passes into the merge component so now every list is constituted of 69 branches and then we merge these two lists using the component and therefore we will have a new list of 69 branches were every branch of the input list is merged with its parallel in the second input list to create one branch so therefore we will have 69 brachnes with 2 items in each branch : first item is the coordinates of one of the agent point and the second is the coordinates of a vector assigned to the point
merge = Merge(Data1=simplify(graft(pt_5)), Data2=simplify(graft(repeat)), Data4=simplify(graft(pt_5)))

# ----
# probably that the loop doesnt accept data as numbers it only accepts geometries like point or lines or breps so that why we chose to use the group objects component that will group the two item in each branch of the list into a group of two " objects "
group = Group(Objects=merge)

pop3d = Populate3D(Region=move.Geometry, Count=Slider(10, range=0..10), Seed=1)  # -> simplify(flatten(Population))
number_slider_3 = Slider(930, range=0..1000)

# ---- group: goal points
pt_6 = Point(pop3d)

pt_7 = Point(pt_6)

# ----
dup = DuplicateData(Data=graft(pt_7), Number=Slider(5, range=0..20), Order=True)  # -> flatten(Data)
lng_2 = ListLength(List=dup)
repeat_2 = RepeatData(Data=Y, Length=lng_2)
vec_2 = Vector(repeat_2)
merge_2 = Merge(Data1=simplify(graft(dup)), Data2=simplify(graft(vec_2)))
group_2 = Group(Objects=merge_2)
loop_start = LoopStart(N=0, T=Button(), D0=group, D1=group_2)  # -> port, Counter, Data, Data_2
ungroup = Ungroup(Group=loop_start.Data_2)
item = ListItem(List=ungroup, Index=0, Wrap=True)  # -> Item, Item1

amp = Amplitude(Vector=item.Item1, Amplitude=Slider(2, range=0..10))

vec2pt = Vector2Pt(Unitize=False)  # -> simplify(Vector), Length
max_vel = Slider(2.349, range=0..10)
maxforce = Slider(0.24, range=0..1)

# ----
# steer
steer = Steer(vel=item.Item1, des=vec2pt.Vector, maxv=max_vel, maxf=maxforce)

# ---- group: point generated every time there is an iteration
pt_8 = Point(flatten(item.Item))

# ---- group: WANDER
wandering_strength = Slider(1, range=0..1)
wandering_angle = Slider(77.327, range=0..90)
rad = Radians(Degrees=wandering_angle)
lng_3 = ListLength(List=flatten(item.Item))
neg_2 = Negative(Value=rad)
dom = ConstructDomain(DomainStart=neg_2, DomainEnd=rad)
Z_2 = UnitZ(Factor=1)
random = Random(Range=dom, Number=lng_3, Seed=loop_start.Counter)  # -> graft(Random)
vrot = Rotate(Vector=item.Item1, Axis=Z_2, Angle=random)
addition = Addition(A=amp, B=vrot)
steer_2 = Steer(vel=item.Item1, des=addition, maxv=max_vel, maxf=wandering_strength)

# ---- group: BORDER CONDITION
crv_cp = CurveClosestPoint(Point=item.Item, Curve=crv)  # -> Point, Parameter, Distance
eval = EvaluateCurve(Curve=crv, Parameter=crv_cp.Parameter)  # -> Point, Tangent, Angle
Z_3 = UnitZ(Factor=1)
smaller = SmallerThan(FirstNumber=crv_cp.Distance, SecondNumber=number_slider)  # -> SmallerThan, OrEqualTo
vec2pt_2 = Vector2Pt(PointA=eval.Point, PointB=item.Item, Unitize=False)  # -> Vector, Length
xprod = CrossProduct(VectorA=eval.Tangent, VectorB=Z_3, Unitize=False)  # -> Vector, Length
dispatch = Dispatch(List=vec2pt_2.Vector, DispatchPattern=smaller.OrEqualTo)  # -> ListA, ListB
easing = Slider(0.35, range=0..1)
vlen = VectorLength(Vector=dispatch.ListA)
subtraction = Subtraction(A=number_slider, B=vlen)
multiplication = Multiplication(A=subtraction, B=easing)
amp_2 = Amplitude(Vector=dispatch.ListA, Amplitude=multiplication)
pt_9 = Point(Point(0, 0, 0))
weave = Weave(Pattern=smaller.OrEqualTo, Stream0=pt_9, Stream1=amp_2, NullGaps=False)

# ----
addition_2 = Addition(A=item.Item1, B=steer_2, C=weave)

trmvec = TrimVector(Vector=addition_2, LengthDomain=max_vel)
move_2 = Move(Geometry=item.Item, Motion=trmvec)  # -> Geometry, Transform

merge_3 = Merge(Data1=simplify(move_2.Geometry), Data2=simplify(trmvec))
group_3 = Group(Objects=merge_3)

pt_10 = Point(item.Item)
move_3 = Move(Geometry=item.Item, Motion=item.Item1)  # -> Geometry, Transform

# ---- group: WANDER
vdisex = VectorDisplayEx(Point=pt_10, Vector=steer_2, Colour=ColourSwatch(SwatchColor=RGB(168, 0, 146)), Width=2)

# ---- group: VELOCITY
vdisex_2 = VectorDisplayEx(Point=pt_10, Vector=item.Item1, Colour=ColourSwatch(SwatchColor=RGB(0, 109, 168)), Width=2)

# ---- group: FINAL VECTOR
vdisex_3 = VectorDisplayEx(Point=pt_10, Vector=trmvec, Colour=ColourSwatch(SwatchColor=RGB(255, 255, 255)), Width=2)

# ---- group: BOUNDARY
vdisex_4 = VectorDisplayEx(Point=eval.Point, Vector=amp_2, Colour=RGB(0, 0, 0), Width=2)

# ---- group: SEEK
vdisex_5 = VectorDisplayEx(Point=move_3.Geometry, Colour=RGB(0, 0, 0), Width=2)

# ----
# so now we ungroup the objects and the list will come back to its natural data numbers and then we will separate each item of every branch aside to have back the points coordinates and their vectors coordinates
ungroup_2 = Ungroup(Group=loop_start.Data)  # -> simplify(Objects)

split = SplitList(List=ungroup_2, Index=Slider(2, range=0..10))  # -> ListA, ListB

item_2 = ListItem(List=split.ListA, Index=0, Wrap=True)  # -> simplify(Item), Item1

# ---- group: agent points back again
# moving the point using the vector V
pt_11 = Point(item_2.Item)

# ---- group: their vectors
vec_3 = Vector(item_2.Item1)

# ----
# this component amplitude is used to be able to control the z coordinate that we gave this vector at first before inserting it in the start of the loop so the slider will give the vector of each point its new amplitude
number_slider_4 = Slider(1, range=0..1)
amp_3 = Amplitude(Vector=vec_3, Amplitude=number_slider_4)

# ----
# first step is moving these points using these vectors as direction in order to reach the goal points
move_4 = Move(Geometry=pt_11, Motion=amp_3)  # -> simplify(Geometry), Transform

panel_3 = Panel(move_4.Geometry)

# ----
# the relation that we created here is based on finding the closest goal pont to each point from the list of 69 branches , so now to each point after choosing 3 closest points we will have the 3 closest point , and then we added the average component that will find the average point between the three point and assign it to each agent point and thats the way we will be able to draw the vector from agent point to goal point
number_slider_5 = Slider(1, range=0..10)
cps = ClosestPoints(Point=move_4.Geometry, Cloud=pt_8, Count=number_slider_5)  # -> simplify(ClosestPoint), CPIndex, Distance
panel_4 = Panel(cps.ClosestPoint)

# ----
# this represents the total vector from each agent point to the goal point
vec2pt_3 = Vector2Pt(PointA=move_4.Geometry, PointB=cps.ClosestPoint, Unitize=False)  # -> Vector, Length

# ----
# this small script is done mainly to find the acceleration which is translated in the vector S in the equation S = D - v , so in order to find S we started by trimming the vector D which is the vector from the agent point immediately to the goal point , by trimming it the point will take more time to reach the goal point , secondly we did solve the equation after subtracting the original vector of the agent point from the D vector in order to find S which is a vector that represents the movement of the agents towards the goal points, secondly  we will have to multiply this vector with its force that will give him a boost to go there
speed_of_movement = Slider(3.22, range=0..5)
trmvec_2 = TrimVector(Vector=vec2pt_3.Vector, LengthDomain=speed_of_movement)
subtraction_2 = Subtraction(A=trmvec_2, B=vec_3)  # -> simplify(Result)
multiplication_2 = Multiplication(A=subtraction_2, B=Slider(0.515, range=0..1))

# ----
# this vector s will be added to the vector v once again to give it its final coordinates
addition_3 = Addition(A=simplify(vec_3), B=multiplication_2)
trmvec_3 = TrimVector(Vector=addition_3, LengthDomain=speed_of_movement)

move_5 = Move(Geometry=pt_11, Motion=trmvec_3)  # -> Geometry, Transform
merge_4 = Merge(Data1=simplify(move_5.Geometry), Data2=simplify(split.ListB))

# ----
# we entered the loop in a group of objects so we end up with also group of objects after merging the data and then grouping it
merge_5 = Merge(Data1=simplify(move_5.Geometry), Data2=simplify(trmvec_3), Data3=simplify(merge_4))
group_4 = Group(Objects=merge_5)

loop_end = LoopEnd(
    port=loop_start.port,
    Exit=False,
    Data=group_4,
    Data_2=simplify(group_3),
    pausedState=False,
    state="Constant output",
    TimeOutVal=0)  # -> D0, D1
ungroup_3 = Ungroup(Group=loop_end.D0)
split_2 = SplitList(List=ungroup_3, Index=Slider(2, range=0..10))  # -> ListA, ListB
pline = PolyLine(Vertices=split_2.ListB, Closed=False)

# ==== cluster Steer
maxf = ClusterInput()
vel = ClusterInput()
maxv = ClusterInput()
des = ClusterInput()
amp = Amplitude(Vector=des, Amplitude=maxv)
subtraction = Subtraction(A=amp, B=vel)
multiplication = Multiplication(A=subtraction, B=maxf)
vlen = VectorLength(Vector=multiplication)
min = Minimum(A=vlen, B=maxv)
amp_2 = Amplitude(Vector=multiplication, Amplitude=min)
acc = ClusterOutput(amp_2)
