# Grasshopper definition Mycelium behavior- Nour Mezher.gh (Grasshopper 0.9.76)
# plug-ins: Anemone, Boid, Weaverbird, Noise 4D

crv = Curve(<curve referenced from the Rhino model>)

number_slider = Slider(44, range=0..100)  # disabled
pop3d = Populate3D(Region={Plane=PlaneXY(0, 0, 0), X=Domain(0, 10), Y=Domain(0, 10), Z=Domain(0, 2)}, Count=number_slider, Seed=1)  # disabled
pt = Point(pop3d)  # disabled
number_slider_2 = Slider(44, range=0..100)  # disabled
X = UnitX(Factor=1)  # disabled
button = Button()  # disabled
lng = ListLength(List=pt)  # disabled
repeat = RepeatData(Data=X, Length=lng)  # disabled
loop_start = LoopStart(N=number_slider_2, T=button, D0=pt, D1=repeat)  # -> port, Counter, Data, Data_2; disabled
number_slider_3 = Slider(2, range=0..10)  # disabled
number_slider_4 = Slider(0.7, range=0..1)  # disabled
avr = Average(Input=loop_start.Data)  # disabled
neg = Negative(Value=number_slider_3)  # disabled
pcharge = PointCharge(Point=avr, Charge=neg, Decay=number_slider_4)  # disabled
number_slider_5 = Slider(26, range=0..100)  # disabled
number_slider_6 = Slider(1, range=0..1)  # disabled
mergef = MergeFields(Fields=pcharge)  # disabled
number_slider_7 = Slider(0.09, range=0..0.1)  # disabled
evf = EvaluateField(Field=mergef, Point=loop_start.Data)  # -> Tensor, Strength; disabled
rad = Radians(Degrees=number_slider_5)  # disabled
number_slider_8 = Slider(1, range=0..1)  # disabled
wander = RandomWander(
    AgentMotionVectors=loop_start.Data_2,
    AngleSpreadDomain=rad,
    RandomSeed=loop_start.Counter,
    AbsoluteMultiplier=number_slider_6)  # disabled
adhere = AhereToTheFlockCenter(
    AgentLocationPoint=loop_start.Data,
    LocationPointsOfTheFlock=loop_start.Data,
    SearchDistance=Domain(0, 0),
    ReferenceAgentsCount=-1,
    Multiplier=number_slider_7)  # disabled
addition = Addition(A=adhere, B=wander)  # disabled
addition_2 = Addition(A=loop_start.Data_2, B=addition)  # disabled
trmvec = TrimVector(Vector=addition_2, LengthDomain=number_slider_8)  # disabled
move = Move(Geometry=loop_start.Data, Motion=trmvec)  # -> Geometry, Transform; disabled
loop_end = LoopEnd(
    port=loop_start.port,
    Exit=False,
    Data=move.Geometry,
    Data_2=trmvec,
    pausedState=False,
    state="Constant & Record",
    TimeOutVal=0)  # -> D0, D1; disabled
flip = FlipMatrix(Data=loop_end.D0)  # disabled
pline = PolyLine(Vertices=flip, Closed=False)  # disabled
panel = Panel(flip)  # disabled

number_slider_9 = Slider(18, range=0..100)  # disabled
pt_2 = Point(<point referenced from the Rhino model>)  # disabled
loop_start_2 = LoopStart(Repeat=number_slider_9, Data=pt_2)  # -> port, Counter, Data; disabled
X_2 = UnitX(Factor=1)  # disabled
move_2 = Move(Geometry=loop_start_2.Data, Motion=X_2)  # -> Geometry, Transform; disabled
vdis = VectorDisplay(Anchor=loop_start_2.Data, Vector=X_2)  # disabled
loop_end_2 = LoopEnd(port=loop_start_2.port, Exit=False, Data=move_2.Geometry, pausedState=False, state="Constant output", TimeOutVal=0)  # disabled

timer = Timer(TimerInterval=1000, Target=panel_2)  # disabled
panel_2 = Panel("now")  # disabled
panel_3 = Panel(""":
)""")  # disabled
time = Time(panel_2)  # disabled
number_slider_10 = Slider(2, range=0..10)  # disabled
split = TextSplit(Text=time, Separators=panel_3)  # disabled
panel_4 = Panel(split)  # disabled
item = ListItem(List=split, Index=number_slider_10, Wrap=True)  # disabled
panel_5 = Panel(item)  # disabled

explode = Explode(Curve=crv, Recursive=True)  # -> Segments, Vertices

# ---- group: AGENT LOC
pt_3 = Point([<point referenced from the Rhino model> x7])

# ----
number_slider_11 = Slider(3.6, range=0..10)  # disabled

# ---- group: AGENT LOC
pt_4 = Point([<point referenced from the Rhino model> x7])  # disabled

# ----
item_2 = ListItem(List=explode.Segments, Index=Slider(3, range=0..3), Wrap=True)
divide = DivideCurve(Curve=item_2, Count=Slider(6, range=0..100), Kinks=False)  # -> Points, Tangents, Parameters
lng_2 = ListLength(List=pt_4)  # disabled
Z = UnitZ(Factor=number_slider_11)  # disabled
lng_3 = ListLength(List=divide.Points)
Z_2 = UnitZ(Factor=Slider(1.2, range=0..10))

# ---- group: AGENTS VELOCITY
repeat_2 = RepeatData(Data=Z, Length=lng_2)  # disabled

repeat_3 = RepeatData(Data=Z_2, Length=lng_3)

# ----
merge = Merge(Data1=simplify(graft(pt_4)), Data2=simplify(graft(repeat_2)), Data4=simplify(graft(pt_4)))  # disabled
merge_2 = Merge(Data1=simplify(graft(divide.Points)), Data2=simplify(graft(repeat_3)), Data4=simplify(graft(divide.Points)))
number_slider_12 = Slider(100, range=0..1100)  # disabled
button_2 = Button()  # disabled
group = Group(Objects=merge)  # disabled
group_2 = Group(Objects=merge_2)
loop_start_3 = LoopStart(Repeat=number_slider_12, Trigger=button_2, Data=group)  # -> port, Counter, Data; disabled
number_slider_13 = Slider(2, range=0..10)  # disabled
loop_start_4 = LoopStart(Repeat=Slider(0, range=0..1100), Trigger=Button(), Data=group_2)  # -> port, Counter, Data
number_slider_14 = Slider(2, range=0..10)
ungroup = Ungroup(Group=loop_start_3.Data)  # disabled
panel_6 = Panel(loop_start_3.Counter)  # disabled
ungroup_2 = Ungroup(Group=loop_start_4.Data)
panel_7 = Panel(loop_start_4.Counter)
crv_2 = Curve(<curve referenced from the Rhino model>)  # disabled
split_2 = SplitList(List=ungroup, Index=number_slider_13)  # -> ListA, ListB; disabled

# ---- group: GOALS
explode_2 = Explode(Curve=crv, Recursive=True)  # -> Segments, Vertices
item_3 = ListItem(List=explode_2.Segments, Index=Slider(1, range=0..3), Wrap=True)
divide_2 = DivideCurve(Curve=item_3, Count=10, Kinks=False)  # -> Points, Tangents, Parameters
pt_5 = Point(divide_2.Points)

# ----
split_3 = SplitList(List=ungroup_2, Index=number_slider_14)  # -> ListA, ListB
item_4 = ListItem(List=split_2.ListA, Index=0, Wrap=True)  # -> Item, Item1; disabled
item_5 = ListItem(List=split_3.ListA, Index=0, Wrap=True)  # -> Item, Item1

# ---- group: LOC
pt_6 = Point(item_4.Item)  # disabled

# ---- group: VEL
vec = Vector(item_4.Item1)  # disabled

# ---- group: LOC
pt_7 = Point(item_5.Item)

# ---- group: VEL
vec_2 = Vector(item_5.Item1)

# ---- group: FUTURE LOC
number_slider_15 = Slider(0.4, range=0..5)  # disabled
amp = Amplitude(Vector=vec, Amplitude=number_slider_15)  # disabled
move_3 = Move(Geometry=pt_6, Motion=amp)  # -> Geometry, Transform; disabled

# ----
number_slider_16 = Slider(100, range=0..100)  # disabled
number_slider_17 = Slider(100, range=0..100)  # disabled
mplane = MeshPlane(Boundary=crv_2, WidthCount=number_slider_17, HeightCount=number_slider_16)  # -> Mesh, Area; disabled
number_slider_18 = Slider(0.3, range=0..1)  # disabled
number_slider_19 = Slider(0.0887, range=0..1)  # disabled
demesh = DeconstructMesh(Mesh=mplane.Mesh)  # -> Vertices, Faces, Colours, Normals; disabled
perlin = PerlinNoise(Values=demesh.Vertices, Time=number_slider_18, Scale=number_slider_19)  # disabled
panel_8 = Panel("-1")  # disabled
gradient = Gradient(LowerLimit=panel_8, UpperLimit=1, Parameter=perlin, stops=[0: RGB(255, 255, 255), 1: RGB(0, 0, 0)])  # disabled
conmesh = ConstructMesh(Vertices=demesh.Vertices, Faces=demesh.Faces, Colours=gradient)  # disabled
number_slider_20 = Slider(23, range=0..100)  # disabled
demesh_2 = DeconstructMesh(Mesh=conmesh)  # -> Vertices, Faces, Colours, Normals; disabled
cps = ClosestPoints(Point=move_3.Geometry, Cloud=demesh_2.Vertices, Count=number_slider_20)  # -> ClosestPoint, CPIndex, Distance; disabled
item_6 = ListItem(List=demesh_2.Colours, Index=cps.CPIndex, Wrap=True)  # disabled
ahsv = SplitAHSV(Colour=item_6)  # -> Alpha, Hue, Saturation, Value; disabled
preview = CustomPreview(Geometry=cps.ClosestPoint, Shader=item_6)  # disabled
sort = SortList(Keys=ahsv.Value, ValuesA=cps.ClosestPoint)  # -> Keys, ValuesA; disabled
panel_9 = Panel(ahsv.Value)  # disabled
item_7 = ListItem(List=sort.ValuesA, Index=0, Wrap=True)  # -> Item1, Item; disabled

# ---- group: FUTURE LOC
amp_2 = Amplitude(Vector=vec_2, Amplitude=Slider(0.4, range=0..5))
move_4 = Move(Geometry=pt_7, Motion=amp_2)  # -> Geometry, Transform

# ----
mplane_2 = MeshPlane(Boundary=crv, WidthCount=Slider(100, range=0..100), HeightCount=Slider(100, range=0..100))  # -> Mesh, Area
demesh_3 = DeconstructMesh(Mesh=mplane_2.Mesh)  # -> Vertices, Faces, Colours, Normals
perlin_2 = PerlinNoise(Values=demesh_3.Vertices, Time=Slider(0.3, range=0..1), Scale=Slider(0.0706, range=0..1))
gradient_2 = Gradient(LowerLimit="-1", UpperLimit=1, Parameter=perlin_2, stops=[0: RGB(255, 255, 255), 1: RGB(0, 0, 0)])
conmesh_2 = ConstructMesh(Vertices=demesh_3.Vertices, Faces=demesh_3.Faces, Colours=gradient_2)
radius_for_the_closest_point = Slider(26, range=0..100)
demesh_4 = DeconstructMesh(Mesh=conmesh_2)  # -> Vertices, Faces, Colours, Normals
cps_2 = ClosestPoints(Point=move_4.Geometry, Cloud=demesh_4.Vertices, Count=radius_for_the_closest_point)  # -> ClosestPoint, CPIndex, Distance
item_8 = ListItem(List=demesh_4.Colours, Index=cps_2.CPIndex, Wrap=True)
ahsv_2 = SplitAHSV(Colour=item_8)  # -> Alpha, Hue, Saturation, Value
preview_2 = CustomPreview(Geometry=cps_2.ClosestPoint, Shader=item_8)
sort_2 = SortList(Keys=ahsv_2.Value, ValuesA=cps_2.ClosestPoint)  # -> Keys, ValuesA
panel_10 = Panel(ahsv_2.Value)
item_9 = ListItem(List=sort_2.ValuesA, Index=0, Wrap=True)  # -> Item1, Item

# ---- group: GOALS
pt_8 = Point([<point referenced from the Rhino model> x4])

# ----
number_slider_21 = Slider(1, range=0..1)  # disabled

# ---- group: GOALS
pt_9 = Point([<point referenced from the Rhino model> x4])  # disabled

# ----
cps_3 = ClosestPoints(Point=move_4.Geometry, Cloud=pt_5, Count=Slider(1, range=0..1))  # -> ClosestPoint, CPIndex, Distance
cps_4 = ClosestPoints(Point=move_3.Geometry, Cloud=pt_9, Count=number_slider_21)  # -> ClosestPoint, CPIndex, Distance; disabled
avr_2 = Average(Input=flatten(cps_3.ClosestPoint))
avr_3 = Average(Input=flatten(cps_4.ClosestPoint))  # disabled
vec2pt = Vector2Pt(PointA=move_4.Geometry, PointB=cps_3.ClosestPoint, Unitize=False)  # -> Vector, Length

# ---- group: ACCELERATION
max_velocity = Slider(13.2, range=0..110)
trmvec_2 = TrimVector(Vector=vec2pt.Vector, LengthDomain=max_velocity)
subtraction = Subtraction(A=trmvec_2, B=vec_2)
max_force = Slider(0.521, range=0..1)
multiplication = Multiplication(A=subtraction, B=max_force)

# ----
vec2pt_2 = Vector2Pt(PointA=move_3.Geometry, PointB=item_7.Item, Unitize=False)  # -> Vector, Length; disabled
vec2pt_3 = Vector2Pt(PointA=move_4.Geometry, PointB=item_9.Item1, Unitize=False)  # -> Vector, Length

# ---- group: ACCELERATION
max_velocity_2 = Slider(4.1, range=0..10)  # disabled
trmvec_3 = TrimVector(Vector=vec2pt_2.Vector, LengthDomain=max_velocity_2)  # disabled
subtraction_2 = Subtraction(A=trmvec_3, B=vec)  # disabled
max_force_2 = Slider(0.676, range=0..1)  # disabled
multiplication_2 = Multiplication(A=subtraction_2, B=max_force_2)  # disabled

# ----
addition_3 = Addition(A=multiplication, B=vec2pt_3.Vector)
vdisex = VectorDisplayEx(Point=move_4.Geometry, Vector=vec2pt_3.Vector, Colour=RGB(0, 0, 0), Width=2)
addition_4 = Addition(A=vec_2, B=addition_3)
trmvec_4 = TrimVector(Vector=addition_4, LengthDomain=max_velocity)
move_5 = Move(Geometry=pt_7, Motion=trmvec_4)  # -> Geometry, Transform
meshcp = MeshClosestPoint(Point=move_5.Geometry, Mesh=mplane_2.Mesh)  # -> Point, Index, Parameter
vec2pt_4 = Vector2Pt(PointA=move_3.Geometry, PointB=item_7.Item, Unitize=False)  # -> Vector, Length; disabled
addition_5 = Addition(A=vec, B=multiplication_2)  # disabled
addition_6 = Addition(A=multiplication_2, B=vec2pt_4.Vector)  # disabled
trmvec_5 = TrimVector(Vector=addition_5, LengthDomain=max_velocity_2)  # disabled
merge_3 = Merge(Data1=simplify(split_3.ListB), Data2=simplify(meshcp.Point))
move_6 = Move(Geometry=pt_6, Motion=trmvec_5)  # -> Geometry, Transform; disabled
merge_4 = Merge(Data1=simplify(meshcp.Point), Data2=simplify(trmvec_4), Data3=simplify(merge_3))
group_3 = Group(Objects=merge_4)
loop_paused = LoopPaused(port=loop_start_4.port, Exit=False, Data=simplify(group_3), pausedState=True, state="Constant output", TimeOutVal=0)
merge_5 = Merge(Data1=simplify(split_2.ListB), Data2=simplify(move_6.Geometry))  # disabled
ungroup_3 = Ungroup(Group=loop_paused)
merge_6 = Merge(Data1=simplify(move_6.Geometry), Data2=simplify(trmvec_5), Data3=simplify(merge_5))  # disabled
panel_11 = Panel(ungroup_3)
group_4 = Group(Objects=merge_6)  # disabled
split_4 = SplitList(List=ungroup_3, Index=number_slider_14)  # -> ListA, ListB
pt_10 = Point(split_4.ListB)
loop_end_3 = LoopEnd(port=loop_start_3.port, Exit=False, Data=simplify(group_4), pausedState=False, state="Constant output", TimeOutVal=0)  # disabled
ungroup_4 = Ungroup(Group=loop_end_3)  # disabled
pline_2 = PolyLine(Vertices=pt_10, Closed=False)  # -> simplify(Polyline)
panel_12 = Panel(ungroup_4)  # disabled
split_5 = SplitList(List=ungroup_4, Index=number_slider_13)  # -> ListA, ListB; disabled
pt_11 = Point(split_5.ListB)  # disabled
len = Length(Curve=pline_2)
pline_3 = PolyLine(Vertices=pt_11, Closed=False)  # -> simplify(Polyline); disabled
len_2 = Length(Curve=pline_3)  # disabled

number_slider_22 = Slider(264, range=0..1000)  # disabled
pt_12 = Point([<point referenced from the Rhino model> x9])  # disabled
vec_3 = Vector()  # disabled

X_3 = UnitX(Factor=1)  # disabled
lng_4 = ListLength(List=pt_12)  # disabled
repeat_4 = RepeatData(Data=X_3, Length=lng_4)  # disabled

loop_start_5 = LoopStart(N=number_slider_22, D0=pt_12, D1=repeat_4)  # -> port, Counter, Data, Data_2; disabled
panel_13 = Panel(loop_start_5.Counter)  # disabled
wander_2 = RandomWander(
    AgentMotionVectors=loop_start_5.Data_2,
    AngleSpreadDomain=Domain(0, 3.141592654),
    RandomSeed=loop_start_5.Counter,
    AbsoluteMultiplier=1)  # disabled
move_7 = Move(Geometry=loop_start_5.Data, Motion=wander_2)  # -> Geometry, Transform; disabled
loop_end_4 = LoopEnd(
    port=loop_start_5.port,
    Exit=False,
    Data=move_7.Geometry,
    Data_2=wander_2,
    pausedState=False,
    state="Constant & Record",
    TimeOutVal=0)  # -> D0, D1; disabled
pt_13 = Point(loop_end_4.D0)  # disabled
flip_2 = FlipMatrix(Data=pt_13)  # disabled
flatten = FlattenTree(Tree=pt_13, Path="{0}")  # disabled
pline_4 = PolyLine(Vertices=flatten, Closed=False)  # disabled
pline_5 = PolyLine(Vertices=flip_2, Closed=False)  # disabled
viewer = ParamViewer(pt_13)  # disabled

number_slider_23 = Slider(3, range=0..10)  # disabled
random = Random(Range=Domain(0, 1), Number=number_slider_23, Seed=loop_start_5.Counter)  # disabled
item_10 = ListItem(List=random, Index=0, Wrap=True)  # -> Item, Item1, Item2; disabled
vec_4 = VectorXYZ(XComponent=item_10.Item, YComponent=item_10.Item1, ZComponent=item_10.Item2)  # -> Vector, Length; disabled
vdis_2 = VectorDisplay(Anchor=loop_start_5.Data, Vector=vec_4.Vector)  # disabled

number_slider_24 = Slider(6, range=0..10)  # disabled
dist = Distance(PointA=pt_12, PointB=move_7.Geometry)  # disabled
larger = LargerThan(FirstNumber=dist, SecondNumber=number_slider_24)  # -> LargerThan, OrEqualTo; disabled

panel_14 = Panel(dist)  # disabled

# ---- group: re-sampling curves
pline_6 = PolyLine(Closed=False)
resolution = Slider(20, range=1..20)
maxpoints = Slider(200, range=100..300)
mesh = Mesh(mplane_2.Mesh)
wbcatmullclark = WeaverbirdsCatmullClarkSubdivision(MeshCurves=mesh, Level=1, SmoothNakedEdges=0)

# ----
division = Division(A=len, B=resolution)
min = Minimum(A=division, B=maxpoints)
int = Integer(min)
divide_3 = DivideCurve(Curve=pline_2, Count=int, Kinks=False)  # -> Points, Tangents, Parameters

# ---- group: re-sampling curves (continued)
meshcp_2 = MeshClosestPoint(Point=divide_3.Points, Mesh=wbcatmullclark)  # -> simplify(Point), Index, Parameter
nurbs = NurbsCurve(Vertices=meshcp_2.Point, Degree=3, Periodic=False)  # -> Curve, Length, Domain
preview_3 = CustomPreview(Geometry=nurbs.Curve, Shader=ColourSwatch(SwatchColor=RGB(0, 0, 0)))

pline_7 = PolyLine(Closed=False)  # disabled
resolution_2 = Slider(20, range=1..20)  # disabled
maxpoints_2 = Slider(200, range=100..300)  # disabled
mesh_2 = Mesh(mplane.Mesh)  # disabled
wbcatmullclark_2 = WeaverbirdsCatmullClarkSubdivision(MeshCurves=mesh_2, Level=1, SmoothNakedEdges=0)  # disabled
swatch = ColourSwatch(SwatchColor=RGB(25, 158, 176))  # disabled

# ----
division_2 = Division(A=len_2, B=resolution_2)  # disabled
min_2 = Minimum(A=division_2, B=maxpoints_2)  # disabled
int_2 = Integer(min_2)  # disabled
divide_4 = DivideCurve(Curve=pline_3, Count=int_2, Kinks=False)  # -> Points, Tangents, Parameters; disabled

# ---- group: re-sampling curves (continued)
meshcp_3 = MeshClosestPoint(Point=divide_4.Points, Mesh=wbcatmullclark_2)  # -> simplify(Point), Index, Parameter; disabled
nurbs_2 = NurbsCurve(Vertices=meshcp_3.Point, Degree=3, Periodic=False)  # -> Curve, Length, Domain; disabled
preview_4 = CustomPreview(Geometry=nurbs_2.Curve, Shader=swatch)  # disabled
