# Grasshopper definition day3.gh (Grasshopper 0.9.76)
# Copyright: Co-de-iT
# plug-ins: Anemone, Boid, HDTReference

# reciproCITY
# ANEMONE
# Alessio Erioli
# Aldo Sollazzo
# Eugenio Bettucchi
# DEFINITIONS BY
# RANDOM WALKER
# RANDOM VECTOR
# 15-17 April 2016
# Points
# Points
# RANDOM VECTOR LOGIC
# Vectors
# RANDOM VECTOR LOGIC
# RANDOM VECTOR LOGIC
# COHESION
# STEER
# steer
# SEEK
# adhere
# adhere vectors logic / steer
# magnetic fields
# PREDATOR PREY
steer = Steer()
# true false
# adhere vectors logic
# adhere vectors logic
# random vectors logic
# FOLLOW COLOR
# ADHERE & REPULSE
steer_2 = Steer()
crv = Curve([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])
crv_2 = Curve([<curve referenced from the Rhino model> x4])
agents1 = Point([Point(-16.75924045, 29.366488, 0), Point(21, 67, 0), Point(67, 45, 0), Point(62, 18, 0), Point(19.83267197, 18.23907849, 0), Point(-3.25215242, 20, 0)])
pt = Point(Point(26, 9, 0))
rev = Reverse()

# ----
# FOLLOW LINE
number_slider = Slider(20, range=0..20)
Y = UnitY(Factor=number_slider)
lng = ListLength(List=agents1)
repeat = RepeatData(Data=Y, Length=lng)
crv_3 = Curve(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)
Y_2 = UnitY(Factor=1)
number_slider_2 = Slider(1, range=0..10)
maxforce = Slider(0.388, range=0..1)

vec = Vector(repeat)
agents = Point([Point(27.66381252, -10.25946277, 0), Point(25.89416457, -24.94754074, 0), Point(17.39985441, -15.21447702, 0), Point(19.16950236, -19.81556169, 0), Point(24.8323758, -12.91393469, 0), Point(31.55703801, -16.45323059, 0), Point(36.33508747, -23.70878718, 0), Point(24.12451662, -28.48683664, 0)])

merge = Merge(Data1=simplify(graft(agents1)), Data2=simplify(graft(vec)))
group = Group(Objects=merge)
loop_start = LoopStart(Repeat=Slider(110, range=0..110), Data=group)  # -> port, Counter, simplify(Data)
panel = Panel(loop_start.Counter)
ungroup = Ungroup(Group=loop_start.Data)
item = ListItem(List=ungroup, Index=0, Wrap=True)  # -> Item, Item1
amp = Amplitude(Vector=item.Item1, Amplitude=Slider(3, range=0..10))
move = Move(Geometry=item.Item, Motion=amp)  # -> Geometry, Transform
crv_cp = CurveClosestPoint(Point=move.Geometry, Curve=simplify(crv))  # -> simplify(Point), simplify(Parameter), simplify(Distance)
pt_2 = Point(item.Item)

panel_2 = Panel(crv_cp.Distance)
sort = SortList(Keys=crv_cp.Distance, ValuesA=crv)  # -> Keys, ValuesA
item_2 = ListItem(List=sort.ValuesA, Index=0, Wrap=True)
crv_4 = Curve(item_2)
crv_cp_2 = CurveClosestPoint(Point=simplify(move.Geometry), Curve=simplify(crv_4))  # -> simplify(Point), simplify(Parameter), simplify(Distance)

# ---- group: VELOCITY
vdisex = VectorDisplayEx(Point=pt_2, Vector=item.Item1, Colour=ColourSwatch(SwatchColor=RGB(0, 109, 168)), Width=2)

# ----
vec2pt = Vector2Pt(PointA=move.Geometry, PointB=crv_cp_2.Point, Unitize=False)  # -> Vector, Length
eval = EvaluateCurve(Curve=crv_4, Parameter=crv_cp_2.Parameter)  # -> Point, Tangent, Angle
multiplication = Multiplication(A=eval.Tangent, B=Slider(0.15, range=0..1))

# ----
# steer
steer_3 = Steer(vel=item.Item1, des=vec2pt.Vector, maxv=number_slider_2, maxf=maxforce)

# ---- group: STEER
vdisex_2 = VectorDisplayEx(Point=pt_2, Vector=steer_3, Colour=RGB(0, 0, 0), Width=2)

# ----
multiplication_2 = Multiplication(A=steer_3, B=Slider(0.13, range=0..1))
addition = Addition(A=multiplication_2, B=multiplication)
addition_2 = Addition(A=item.Item1, B=addition)
trmvec = TrimVector(Vector=addition_2, LengthDomain=number_slider_2)
move_2 = Move(Geometry=item.Item, Motion=trmvec)  # -> Geometry, Transform

vec2pt_2 = Vector2Pt(PointA=move_2.Geometry, PointB=pt, Unitize=False)  # -> Vector, Length
multiplication_3 = Multiplication(A=trmvec, B=vec2pt_2.Vector)
smaller = SmallerThan(FirstNumber=multiplication_3, SecondNumber=Slider(0, range=0..100))  # -> SmallerThan, OrEqualTo
rev_2 = Reverse(Vector=trmvec)
vdis = VectorDisplay(Anchor=move_2.Geometry, Vector=vec2pt_2.Vector)
p_n_c = PickNChoose(Pattern=smaller.SmallerThan, Stream0=trmvec, Stream1=rev_2)

merge_2 = Merge(Data1=move_2.Geometry, Data2=p_n_c)
group_2 = Group(Objects=merge_2)
loop_end = LoopEnd(port=loop_start.port, Exit=False, Data=group_2, pausedState=False, state="Constant & Record", TimeOutVal=0)  # -> simplify(Data)
ungroup_2 = Ungroup(Group=loop_end)
item_3 = ListItem(List=ungroup_2, Index=0, Wrap=True)

panel_3 = Panel(p_n_c)
trim = TrimTree(Tree=simplify(item_3), Depth=1)
flip = FlipMatrix(Data=trim)

# ---- group: FINAL VECTOR
vdisex_3 = VectorDisplayEx(Point=pt_2, Vector=trmvec, Colour=ColourSwatch(SwatchColor=RGB(255, 255, 255)), Width=2)

# ----
pline = PolyLine(Vertices=flip, Closed=False)
previewlw = CustomPreviewLineweights(
    Geometry=pline,
    Shader={ambient=RGB(0, 0, 0), diffuse=RGB(255, 105, 180), emission=RGB(76, 32, 54), shine=0.5, specular=RGB(255, 255, 255), transparency=0},
    Thickness=Slider(5, range=0..10))

# ==== cluster Steer
maxf = ClusterInput()
vel = ClusterInput()
maxv = ClusterInput()
des = ClusterInput()
amp = Amplitude(Vector=des, Amplitude=maxv)
subtraction = Subtraction(A=amp, B=vel)
multiplication = Multiplication(A=subtraction, B=maxf)
vlen = VectorLength(Vector=multiplication)
min = Minimum(A=vlen, B=maxv)
amp_2 = Amplitude(Vector=multiplication, Amplitude=min)
acc = ClusterOutput(amp_2)
